# Grasshopper definition 2.18.gh (Grasshopper 1.0.7)
# plug-ins: Karamba, MeshEdit Components, MKTools, KUKA|prc - parametric robot control, LunchBox, Kangaroo2 Components, Telepathy

# Input
digit_scroller = DigitScroller(Scroller_Digits=12, Scroller_Prefix="Set", Scroller_Radix=9, Scroller_Value=4)
rodtypecount = Get()
panel = Panel(rodtypecount)
panel_2 = Panel("500")
panel_3 = Panel("84")
cut_height = Set("1100")
n = Set(digit_scroller)
radius = Set("2000")
width = Set("61")
strictrodtypecount = Get()
panel_4 = Panel(strictrodtypecount)

# ----
# Ceter Point Projection
radius_2 = Get(radius)  # disabled
panel_5 = Panel("1")  # disabled
ic1s = IcosahedronClass1Subdivision(SubdivisionNumber=panel_5)  # -> Points, LCDPoints; disabled
scale = Scale(Geometry=ic1s.Points, Center=Point(0, 0, 0), Factor=0.5)  # -> Geometry, Transform; disabled
index_1 = Index1(pt=scale.Geometry, R=radius_2)  # disabled
convexhull = _3DConvexHull(Points=index_1)  # disabled
index_1_2 = Index1(pt=index_1, R=radius_2)  # disabled
medges = MeshEdges(Mesh=convexhull)  # -> NakedEdges, InteriorEdges, NonManifoldEdges; disabled
index_1_3 = Index1(pt=index_1_2, R=radius_2)  # disabled
convexhull_2 = _3DConvexHull(Points=index_1_2)  # disabled
medges_2 = MeshEdges(Mesh=convexhull_2)  # -> NakedEdges, InteriorEdges, NonManifoldEdges; disabled
index_1_4 = Index1(pt=index_1_3, R=radius_2)  # disabled
convexhull_3 = _3DConvexHull(Points=index_1_3)  # disabled
medges_3 = MeshEdges(Mesh=convexhull_3)  # -> NakedEdges, InteriorEdges, NonManifoldEdges; disabled
index_1_5 = Index1(pt=index_1_4, R=radius_2)  # disabled
convexhull_4 = _3DConvexHull(Points=index_1_4)  # disabled
medges_4 = MeshEdges(Mesh=convexhull_4)  # -> NakedEdges, InteriorEdges, NonManifoldEdges; disabled
convexhull_5 = _3DConvexHull(Points=index_1_5)  # disabled
medges_5 = MeshEdges(Mesh=convexhull_5)  # -> NakedEdges, InteriorEdges, NonManifoldEdges; disabled
pt = Point(index_1_5)  # disabled
line = Line(medges_5.InteriorEdges)  # disabled
mesh = Mesh(convexhull_5)  # disabled

# ----
# Algorithms
n_2 = Get(n)
ic1s_2 = IcosahedronClass1Subdivision(SubdivisionNumber=n_2)  # -> Points, LCDPoints

n_3 = Get(n)
ic2s = IcosahedronClass2Subdivision(SubdivisionNumber=n_3)  # -> Points, LCDPoints

# ---- group: Basic Tri
panel_6 = Panel("2/sqrt(5),0,1/sqrt(5)")  # disabled
panel_7 = Panel("2*pi/5")  # disabled
panel_8 = Panel("0,0,0")  # disabled
panel_9 = Panel("0,0,1")  # disabled
rot3d = Rotate3D(Geometry=panel_6, Angle=panel_7, Center=Point(0, 0, 0), Axis=Vector(0, 0, 1))  # -> Geometry, Transform; disabled
ln = Line(StartPoint=panel_9, EndPoint=rot3d.Geometry)  # disabled
ln_2 = Line(StartPoint=panel_9, EndPoint=panel_6)  # disabled
ln_3 = Line(StartPoint=panel_6, EndPoint=rot3d.Geometry)  # disabled
merge = Merge(Data1=ln, Data2=ln_2, Data3=ln_3)  # disabled

# ----
radius_3 = Get(radius)
cut_height_2 = Get(cut_height)
addition = Addition(A=radius_3, B=cut_height_2)
addition_2 = Addition(A="-0.1", B=cut_height_2)

width_2 = Get(width)  # disabled
panel_10 = Panel("1")
box_b_0 = Panel(width_2)  # disabled
box_h_0 = Panel(width_2)  # disabled

rectangle = Rectangle(Plane=PlaneXY(0, 0, 0), XSize="-20 To 20", YSize="-20 To 20", Radius=0)  # -> Rectangle, Length
mesh_uv = MeshSurface(Surface=rectangle.Rectangle, UCount="100", VCount="100", Overhang=True, Equalize=False)
radius_4 = Get(radius)
panel_11 = Panel("""0
1""")
width_3 = Get(width)
license = LicenseKaramba3D()

# ---- group: Load
panel_12 = Panel("0,0,-1")
panel_13 = Panel("5")
panel_14 = Panel("0,0,1.36")
panel_16 = Panel("0,0,-0.65")
panel_17 = Panel("0,0,-0.5")
panel_18 = Panel("3")
panel_19 = Panel("27")
panel_20 = Panel("0")
panel_21 = Panel("2")
panel_22 = Panel("-16")
panel_23 = Panel("4")
merge_2 = Merge()  # -> flatten(Result)

# ----
loads = LoadsKaramba3D(Vector=panel_12, LCase=0, mode="Gravity")
loads_2 = LoadsKaramba3D(Vector=panel_14, LCase=0, mode="Gravity")
loads_3 = LoadsKaramba3D(Vector=panel_16, LCase=0, mode="Gravity")
loads_4 = LoadsKaramba3D(Vector=panel_17, LCase=0, mode="Gravity")
panel_24 = Panel("0,0,0")
panel_25 = Panel("100000000,100000000,100000000")
lng = ListLength(List=loads)
load_combination_1 = Panel("""1
1.4
0
0
0
0""")
load_combination_2 = Panel("""1.2
0
1.4
0
0.84
0""")
load_combination_3 = Panel("""1.2
0
1.4
0
0
0.84""")
addition_3 = Addition()
box_h_0_2 = Number(box_h_0)
box_b_1 = Number()
box_b_0_2 = Number(box_b_0)
box_h_1 = Number()

# ---- group: 1
series = Series(Start=0, Step=1, Count=10)
panel_26 = Panel("Glubam1")

# ----
number_slider = Slider(3, range=0..100)  # disabled
number_slider_2 = Slider(-1.45, range=-2..2)
yz = YZPlane(Origin=Point(0, 0, 0))
X = UnitX(Factor=1)  # disabled
width_4 = Get(width)
division = Division(A=width_4, B=2)
X_2 = UnitX(Factor=1)
Z = UnitZ(Factor=division)
Y = UnitY(Factor=1)
bolt_length = Set("28")
nut_radius = Set("7.5")
nut_radius_2 = Get(nut_radius)
nut_radius_3 = Get(nut_radius)
xy = XYPlane(Origin=Point(0, 0, 0))
xy_2 = XYPlane(Origin=Point(0, 0, 0))
speed_move = Set("2")
saw_diameter = Set("205")
nut_height = Set("10")
nut_height_2 = Get(nut_height)
nut_height_3 = Get(nut_height)
speed_drill = Set("0.005")
speed_saw = Set("0.05")
bolt_length_2 = Get(bolt_length)
bolt_length_3 = Get(bolt_length)
width_5 = Get(width)
toggle = BooleanToggle(True)
toggle_2 = BooleanToggle(True)
toggle_3 = BooleanToggle(True)
speed_move_2 = Get(speed_move)
speed_drill_2 = Get(speed_drill)
speed_move_3 = Get(speed_move)
speed_saw_2 = Get(speed_saw)
merge_3 = Merge(Data1=speed_move_2, Data2=speed_drill_2, Data3=speed_move_2)
geo = Geometry(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)
xz = XZPlane(Origin=Point(0, 0, 0))
merge_4 = Merge(Data1=speed_move_3, Data2=speed_saw_2, Data3=speed_move_3)
rotate = Rotate(Geometry=geo, Angle=1.570796327, Plane=xz)  # -> Geometry, Transform
xy_3 = XYPlane(Origin=Point(0, 0, 0))
axis_cyl_length = Set("200")
geo_2 = Geometry(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)
move = Move(Geometry=rotate.Geometry, Motion="225.5,-80,25")  # -> Geometry, Transform
rotate_2 = Rotate(Geometry=geo_2, Angle=1.570796327, Plane=xy_3)  # -> Geometry, Transform
axis_cyl_length_2 = Get(axis_cyl_length)
X_3 = UnitX(Factor="62.5")
saw_diameter_2 = Get(saw_diameter)
c_script = CSharpScript(
    Colour=ColourSwatch(SwatchColor=RGB(247, 247, 247)),
    Reflection=Slider(1, range=0..1),
    Smoothness=Slider(0.213, range=0..1))  # -> Mat; inputs Colour: Color, Reflection: Double, Smoothness: Double
# ---------- c_script: C# ----------
    Reflection = Math.Min(Math.Max(Reflection, 0), 1);
    Smoothness = Math.Min(Math.Max(Smoothness, 0), 1);
        
    Material material = new Material();
    material.ReflectionColor = Colour;
    material.DiffuseColor = Color.White;
    material.AmbientColor = Color.Black;
    material.EmissionColor = Color.Black;
    material.Reflectivity = Reflection;
    material.ReflectionGlossiness = Smoothness;

    var renderMaterial = Rhino.Render.RenderMaterial.CreateBasicMaterial(material);
    Mat = new GH_Material(renderMaterial);
# ---------- end c_script ----------
axis_cyl_length_3 = Get(axis_cyl_length)
axis_cyl_length_4 = Get(axis_cyl_length)
division_2 = Division(A=saw_diameter_2, B=2)

Z_2 = UnitZ(Factor=axis_cyl_length_2)
xy_4 = XYPlane(Origin=Z_2)
cyl = Cylinder(Base=PlaneXY(0, 0, 0), Radius="5", Length=axis_cyl_length_2)
cyl_2 = Cylinder(Base=xy_4, Radius=division_2, Length="2")
cap = CapHoles(Brep=cyl)
cap_2 = CapHoles(Brep=cyl_2)
merge_5 = Merge(Data1=cap, Data2=cap_2)

mcol = MeshColours(Mesh=rotate_2.Geometry, Colours="192,192,192")
mcol_2 = MeshColours(Mesh=move.Geometry, Colours="64,64,64")
cyl_3 = Cylinder(Base=PlaneXY(0, 0, 0), Radius="8", Length=axis_cyl_length_3)
cyl_4 = Cylinder(Base=PlaneXY(0, 0, 0), Radius="4", Length=axis_cyl_length_4)
merge_6 = Merge(Data1=mcol_2, Data2=mcol)
move_2 = Move(Geometry=merge_6, Motion="62.5,0,-6")  # -> Geometry, Transform
cnc = Set(move_2.Geometry)
krl_code = KRLCodeKUKAPrc(KRLAsText="$VEL.CP=2")
cap_3 = CapHoles(Brep=cyl_3)
cap_4 = CapHoles(Brep=cyl_4)
vec = Vector("89.79,0,0")
vec_2 = Vector("780.41,1070.80,541.23")
X_4 = UnitX(Factor="179.92")
X_5 = UnitX(Factor="187.8")
pt_2 = Point("339.75,-2.59,89.46")
pt_3 = Point("339.315,-2.59,89.46")

yz_2 = YZPlane(Origin="583.51,-2.59,89.46")
orient = Orient(Geometry=merge_5, Source=xy_4, Target=yz_2)  # -> Geometry, Transform

subtraction = Subtraction(A=vec_2, B=vec)
addition_4 = Addition(A=pt_2, B=X_4)
addition_5 = Addition(A=pt_3, B=X_5)

panel_27 = Panel("527.11,-2.59,89.46")
yz_3 = YZPlane(Origin=addition_5)
orient_2 = Orient(Geometry=cap_4, Source=xy_4, Target=yz_3)  # -> Geometry, Transform

subtraction_2 = Subtraction(A=subtraction, B=vec)
yz_4 = YZPlane(Origin=addition_4)
subtraction_3 = Subtraction(A=subtraction_2, B=vec)
tool2_loc = Set(vec_2)
tool2_loc_2 = Get(tool2_loc)
tool3_loc = Set(subtraction)
tool4_loc = Set(subtraction_2)
tool4_loc_2 = Get(tool4_loc)
tool5_loc = Set(subtraction_3)
tool5_loc_2 = Get(tool5_loc)
orient_3 = Orient(Geometry=cap_3, Source=xy_4, Target=yz_4)  # -> Geometry, Transform
mcol_3 = MeshColours(Mesh=orient_3.Geometry, Colours="216,216,216")
mcol_4 = MeshColours(Mesh=orient_2.Geometry, Colours="216,216,216")
mcol_5 = MeshColours(Mesh=orient.Geometry, Colours="216,216,216")
cnc_2 = Get(cnc)
cnc_3 = Get(cnc)
cnc_4 = Get(cnc)
cnc_5 = Get(cnc)
panel_28 = Panel("""1108.04,960.68,590.95
1826.08,961.82,590.56
1832.30,-1034.96,593.19
1114.27,-1037.39,594.65""")
number_slider_3 = Slider(0.001545, range=0..0.002)
timer = Timer(TimerInterval=20, Target=panel_30)  # disabled
merge_7 = Merge(Data1=cnc_3, Data2=mcol_3)
merge_8 = Merge(Data1=cnc_5, Data2=mcol_5)
merge_9 = Merge(Data1=cnc_4)
merge_10 = Merge(Data1=cnc_2, Data2=mcol_4)
number_slider_4 = Slider(-0.000564, range=-0.0025..-0.0004)
number_slider_5 = Slider(-0.002037, range=-0.0025..-0.0004)
cull_i = CullIndex(List=panel_28, Indices="0", Wrap=True)
cull_i_2 = CullIndex(List=panel_28, Indices="1", Wrap=True)
panel_29 = Panel("0.001543")
panel_30 = Panel("0.0001")
cull_i_3 = CullIndex(List=panel_28, Indices="2", Wrap=True)
cull_i_4 = CullIndex(List=panel_28, Indices="3", Wrap=True)
vec_3 = Vector("0, 0, -4.5375")
custom_tool = CustomToolKUKAPrc(
    CustomToolGeometry=merge_9,
    toolid=1,
    toolvala=0,
    toolvalb=0,
    toolvalc=0,
    toolvalx=483.74,
    toolvaly=-2.59,
    toolvalz=89.46,
    valuesset=True)
custom_tool_2 = CustomToolKUKAPrc(
    CustomToolGeometry=merge_8,
    toolid=2,
    toolvala=0,
    toolvalb=0,
    toolvalc=0,
    toolvalx=583.51,
    toolvaly=-2.59,
    toolvalz=89.46,
    valuesset=True)
custom_tool_3 = CustomToolKUKAPrc(
    CustomToolGeometry=merge_7,
    toolid=5,
    toolvala=0,
    toolvalb=0,
    toolvalc=0,
    toolvalx=519.23,
    toolvaly=-2.59,
    toolvalz=89.46,
    valuesset=True)
custom_tool_4 = CustomToolKUKAPrc(
    CustomToolGeometry=merge_10,
    toolid=4,
    toolvala=0,
    toolvalb=0,
    toolvalc=0,
    toolvalx=527.11,
    toolvaly=-2.59,
    toolvalz=89.46,
    valuesset=True)
rec = DataRecorder(panel_30, DataLimit=-10, RecordData=True)
X_6 = UnitX(Factor=1)
number_slider_6 = Slider(0, range=0..1)
item = ListItem(List=cull_i, Index=0, Wrap=True)  # -> Item, Item1, Item2
item_2 = ListItem(List=cull_i_2, Index=0, Wrap=True)  # -> Item, Item1, Item2
item_3 = ListItem(List=cull_i_3, Index=0, Wrap=True)  # -> Item, Item1, Item2
item_4 = ListItem(List=cull_i_4, Index=0, Wrap=True)  # -> Item, Item1, Item2
ma = MassAddition(Input=rec)  # -> Result, PartialResults
pl_3pt = Plane3Pt(PointA=item.Item, PointB=item.Item1, PointC=item.Item2)
pl_3pt_2 = Plane3Pt(PointA=item_2.Item, PointB=item_2.Item1, PointC=item_2.Item2)
pl_3pt_3 = Plane3Pt(PointA=item_3.Item, PointB=item_3.Item1, PointC=item_3.Item2)
pl_3pt_4 = Plane3Pt(PointA=item_4.Item, PointB=item_4.Item1, PointC=item_4.Item2)
panel_31 = Panel("-0.0013")
Y_2 = UnitY(Factor=1)
panel_32 = Panel(ma.Result)
panel_33 = Panel("-133,-200,0")  # disabled
panel_34 = Panel("-133,200,0")  # disabled
merge_11 = Merge(Data1=pl_3pt, Data2=pl_3pt_2, Data3=pl_3pt_3, Data4=pl_3pt_4)
tool_2 = Set(custom_tool_2)
tool_2_2 = Get(tool_2)
fetch = Fetch(pt=tool2_loc_2, tool=tool_2_2, F="120", wait="5")
tool_4 = Set(custom_tool_4)
tool_4_2 = Get(tool_4)
fetch_2 = Fetch(pt=tool4_loc_2, tool=tool_4_2, F="90", wait="2")
tool_5 = Set(custom_tool_3)
tool_5_2 = Get(tool_5)
fetch_3 = Fetch(pt=tool5_loc_2, tool=tool_5_2, F="90", wait="2")
tool_1 = Set(custom_tool)
tool_1_2 = Get(tool_1)
tool_1_3 = Get(tool_1)
tool_1_4 = Get(tool_1)
return = Return(wait="3", pt=tool2_loc_2, tool=tool_1_3)
return_2 = Return(wait="0", pt=tool4_loc_2, tool=tool_1_4)
return_3 = Return(wait="0", pt=tool5_loc_2, tool=tool_1_2)
vec_4 = Vector(merge_11)
addition_6 = Addition()
avr = Average(Input=vec_4)
Z_3 = UnitZ(Factor=1)
panel_35 = Panel("50")  # disabled
yz_5 = YZPlane(Origin=Point(0, 0, 0))
xz_2 = XZPlane(Origin=Point(0, 0, 0))
speed_move_4 = Get(speed_move)  # disabled
speed_move_5 = Get(speed_move)
kr90_kr270_r2700 = QuantecKR90KR270R2700Robot(infiniterot=False)
angle = Angle(VectorA=avr, VectorB=Z_3, Plane=yz_5)  # -> Angle, Reflex
angle_2 = Angle(VectorA=avr, VectorB=Z_3, Plane=xz_2)  # -> Angle, Reflex
tool_1_5 = Get(tool_1)
subtraction_4 = Subtraction(A=angle.Angle, B=3.141592654)
rot3d_2 = Rotate3D(Geometry=panel_28, Angle=subtraction_4, Center=Point(0, 0, 0), Axis=X_6)  # -> Geometry, Transform
panel_36 = Panel(rot3d_2.Geometry)
subtraction_5 = Subtraction(A=3.141592654, B=angle_2.Angle)
rot3d_3 = Rotate3D(Geometry=rot3d_2.Geometry, Angle=subtraction_5, Center=Point(0, 0, 0), Axis=Y_2)  # -> Geometry, Transform
panel_37 = Panel(rot3d_3.Geometry)
c_script_2 = CSharpScript(Colour=ColourSwatch(SwatchColor=RGB(0, 0, 0)), Reflection=Slider(1, range=0..1), Smoothness=Slider(0.509, range=0..1))  # -> Mat; inputs Colour: Color, Reflection: Double, Smoothness: Double; same code as c_script
c_script_3 = CSharpScript(
    Colour=ColourSwatch(SwatchColor=RGB(247, 128, 0)),
    Reflection=Slider(1, range=0..1),
    Smoothness=Slider(0.505, range=0..1))  # -> Mat; inputs Colour: Color, Reflection: Double, Smoothness: Double; same code as c_script
c_script_4 = CSharpScript(
    Colour=ColourSwatch(SwatchColor=RGB(247, 247, 247)),
    Reflection=Slider(1, range=0..1),
    Smoothness=Slider(0.213, range=0..1))  # -> Mat; inputs Colour: Color, Reflection: Double, Smoothness: Double; same code as c_script
c_script_5 = CSharpScript(
    Colour=ColourSwatch(SwatchColor=RGB(214, 162, 49)),
    Reflection=Slider(0.955, range=0..1),
    Smoothness=Slider(1, range=0..1))  # -> Mat; inputs Colour: Color, Reflection: Double, Smoothness: Double; same code as c_script
number_slider_7 = Slider(-0.003116, range=-0.0032..-0.003)
panel_38 = Panel("8")
rod_type = Set(panel_38)
rod_type_2 = Get(rod_type)
aluminium = Set(c_script_4)
black = Set(c_script_2)
orange = Set(c_script_3)
x = Panel(subtraction_4)
z = Panel("-0.0031165")
y = Panel(subtraction_5)
rot3d_4 = Rotate3D(Geometry=rot3d_3.Geometry, Angle=z, Center=Point(0, 0, 0), Axis=Vector(0, 0, 1))  # -> Geometry, Transform
rotate_x = Set(x)
rotate_x_2 = Get(rotate_x)
rotate_z = Set(z)
rotate_z_2 = Get(rotate_z)
rotate_y = Set(y)
rotate_y_2 = Get(rotate_y)
panel_39 = Panel(rot3d_4.Geometry)
aluminium_2 = Get(aluminium)  # disabled
orange_2 = Get(orange)  # disabled
black_2 = Get(black)  # disabled

jointtypecount = Get()
rodtypecount_2 = Get()
jointtype = Get()
rodtype = Get()
panel_40 = Panel(jointtype)
panel_41 = Panel(rodtype)
panel_42 = Panel(rodtypecount_2)
panel_43 = Panel(jointtypecount)
jointcount = Get()
rodcount = Get()
panel_44 = Panel(rodcount)
panel_45 = Panel(jointcount)

# ----
# Equal Chord
original = Set(panel_8)  # disabled
firstpoint = Set(panel_9)  # disabled
secondpoint = Set(panel_6)  # disabled
thirdpoint = Set(rot3d.Geometry)  # disabled
n_4 = Get(n)  # disabled
n_5 = Get(n)  # disabled
original_2 = Get(original)  # disabled
sph = Sphere(Base=PlaneXY(0, 0, 0), Radius=1)  # disabled
radius_5 = Get(radius)  # disabled
panel_46 = Panel("0.001")  # disabled

# ---- group: Get Arc
firstpoint_2 = Get(firstpoint)  # disabled
original_3 = Get(original)  # disabled
secondpoint_2 = Get(secondpoint)  # disabled
original_4 = Get(original)  # disabled
firstpoint_3 = Get(firstpoint)  # disabled
thirdpoint_2 = Get(thirdpoint)  # disabled
original_5 = Get(original)  # disabled
secondpoint_3 = Get(secondpoint)  # disabled
thirdpoint_3 = Get(thirdpoint)  # disabled
pl_3pt_5 = Plane3Pt(PointA=original_3, PointB=firstpoint_2, PointC=secondpoint_2)  # disabled
pl_3pt_6 = Plane3Pt(PointA=original_4, PointB=firstpoint_3, PointC=thirdpoint_2)  # disabled
pl_3pt_7 = Plane3Pt(PointA=original_5, PointB=secondpoint_3, PointC=thirdpoint_3)  # disabled
firstplane = Set(pl_3pt_7)  # disabled

# ---- group: Divide Arc
divide = DivideCurve(Curve=ln_2, Count=n_4, Kinks=False)  # -> Points, Tangents, Parameters; disabled
divide_2 = DivideCurve(Curve=ln, Count=n_4, Kinks=False)  # -> Points, Tangents, Parameters; disabled
divide_3 = DivideCurve(Curve=ln_3, Count=n_4, Kinks=False)  # -> Points, Tangents, Parameters; disabled
panel_47 = Panel("0")  # disabled
panel_48 = Panel("0")  # disabled
cull_i_5 = CullIndex(List=divide.Points, Indices=panel_47, Wrap=True)  # disabled
cull_i_6 = CullIndex(List=divide_2.Points, Indices=panel_48, Wrap=True)  # disabled

# ----
radius_6 = Get(radius)
scale_2 = Scale(Geometry=ic2s.Points, Center=Point(0, 0, 0), Factor=radius_6)  # -> Geometry, Transform
scale_3 = Scale(Geometry=ic2s.Points, Center=Point(0, 0, 0), Factor=radius_6)  # -> Geometry, Transform
p_lcd = Set(scale_2.Geometry)
pt_4 = Point(scale_3.Geometry)
panel_50 = Panel("0.001")
duppt = RemoveDuplicatePts(Points=pt_4, Tolerance=0.01)
pt_5 = Point(duppt)

# ---- group: Connect
convexhull_6 = _3DConvexHull(Points=duppt)
medges_6 = MeshEdges(Mesh=convexhull_6)  # -> NakedEdges, InteriorEdges, NonManifoldEdges
merge_12 = Merge(Data1=medges_6.NakedEdges, Data2=medges_6.InteriorEdges, Data3=medges_6.NonManifoldEdges)

# ----
line_2 = Line(merge_12)
mesh_2 = Mesh(convexhull_6)

mesh_all = Set(mesh_2)
points_all = Set(pt_5)
lines_all = Set(line_2)
# cull
lines_all_2 = Get(lines_all)

# ---- group: Half
end = EndPoints(Curve=lines_all_2)  # -> Start, End
pdecon = Deconstruct(Point=end.Start)  # -> XComponent, YComponent, ZComponent
pdecon_2 = Deconstruct(Point=end.End)  # -> XComponent, YComponent, ZComponent
larger = LargerThan(FirstNumber=pdecon.ZComponent, SecondNumber=addition_2)  # -> LargerThan, OrEqualTo
larger_2 = LargerThan(FirstNumber=pdecon_2.ZComponent, SecondNumber=addition_2)  # -> LargerThan, OrEqualTo
and = GateAnd(A=larger.LargerThan, B=larger_2.LargerThan)
cull = CullPattern(List=lines_all_2, CullPattern=and)

# ----
midpt = CurveMiddle(Curve=lines_all_2)
pdecon_3 = Deconstruct(Point=midpt)  # -> XComponent, YComponent, ZComponent
larger_3 = LargerThan(FirstNumber=pdecon_3.ZComponent, SecondNumber=addition_2)  # -> LargerThan, OrEqualTo
mesh_all_2 = Get(mesh_all)

# ---- group: ShellHeight
end_2 = EndPoints(Curve=cull)  # -> Start, End
merge_13 = Merge(Data1=end_2.Start, Data2=end_2.End)
pdecon_4 = Deconstruct(Point=merge_13)  # -> XComponent, YComponent, ZComponent
maxmin = MaxMin(Numbers=flatten(pdecon_4.ZComponent))  # -> Min, Max
subtraction_6 = Subtraction(A=maxmin.Max, B=maxmin.Min)

# ----
msplit = MeshSplit(Mesh=mesh_all_2, Splitters=mesh_uv)
item_5 = ListItem(List=msplit, Index=0, Wrap=True)
maxmin_2 = MaxMin(Numbers=flatten(pdecon_4.XComponent))  # -> Min, Max
subtraction_7 = Subtraction(A=maxmin_2.Max, B=maxmin_2.Min)
shell_height = Set(subtraction_6)
shell_span = Set(subtraction_7)
# Output
shell_span_2 = Get(shell_span)
panel_51 = Panel(shell_span_2)
filters = Set(and)
lines_culled = Set(cull)
lines_culled_2 = Get(lines_culled)
lines_culled_3 = Get(lines_culled)
scale_4 = Scale(Geometry=lines_culled_3, Center=Point(0, 0, 0), Factor="0.001")  # -> Geometry, Transform
end_3 = EndPoints(Curve=scale_4.Geometry)  # -> Start, End
merge_14 = Merge(Data1=end_3.Start, Data2=end_3.End)
duppt_2 = RemoveDuplicatePts(Points=merge_14, Tolerance=0.01)
pdecon_5 = Deconstruct(Point=duppt_2)  # -> XComponent, YComponent, ZComponent
maxmin_3 = MaxMin(Numbers=pdecon_5.ZComponent)  # -> Min, Max
subtraction_8 = Subtraction(A=pdecon_5.ZComponent, B=maxmin_3.Min)
addition_7 = Addition(A=maxmin_3.Min, B="0.001")
abs = Absolute(Value=subtraction_8)
smaller = SmallerThan(FirstNumber=pdecon_5.ZComponent, SecondNumber=addition_7)  # -> SmallerThan, OrEqualTo
cull_2 = CullPattern(List=duppt_2, CullPattern=smaller.SmallerThan)
cull_i_7 = CullIndex(List=cull_2, Indices=panel_11, Wrap=True)
item_6 = ListItem(List=cull_2, Index=0, Wrap=True)  # -> Item, Item1
len = Length(Curve=lines_culled_3)

box_b_0_3 = Number(width_3)
box_h_0_3 = Number(width_3)
line_3 = Line(scale_4.Geometry)
pt_release_none = Point(cull_2)
pt_release_x = Point(item_6.Item1)  # disabled
pt_release_xy = Point(flatten(cull_i_7))  # disabled

ma_2 = MassAddition(Input=len)  # -> Result, PartialResults

# ---- group: Support
supp = SupportKaramba(PosInd=pt_release_none, menu=[buttons(on, on, on, off, off, off)])
supp_2 = SupportKaramba(PosInd=pt_release_x, menu=[buttons(off, on, on, off, off, off)])
supp_3 = SupportKaramba(PosInd=pt_release_xy, menu=[buttons(off, off, on, off, off, off)])
merge_15 = Merge(Data1=supp, Data2=supp_2, Data3=supp_3)

# ----
# Elongation
lines_culled_4 = Get(lines_culled)
lines_all_3 = Get(lines_all)
# Statistics
lines_culled_5 = Get(lines_culled)
line_4 = Line(lines_all_3)
len_2 = Length(Curve=lines_culled_5)
lng_2 = ListLength(List=lines_culled_5)
lengths = Set(len_2)
count = Set(lng_2)
lengths_2 = Get(lengths)
lengths_3 = Get(lengths)
lengths_4 = Get(lengths)
maxmin_4 = MaxMin(Numbers=lengths_4)  # -> Min, Max
avr_2 = Average(Input=lengths_3)
mean = Set(avr_2)
mean_2 = Get(mean)
mean_3 = Get(mean)
subtraction_9 = Subtraction(A=lengths_2, B=mean_2)
sqr = Square(Value=subtraction_9)
subtraction_10 = Subtraction(A=maxmin_4.Max, B=maxmin_4.Min)
mean_4 = Get(mean)
avr_3 = Average(Input=sqr)
division_3 = Division(A=subtraction_10, B=mean_4)
var = Set(avr_3)
var_2 = Get(var)
sqrt = SquareRoot(Value=var_2)
std = Set(sqrt)
std_2 = Get(std)
division_4 = Division(A=std_2, B=mean_3)
cv = Set(division_4)
cv_2 = Get(cv)
multiplication = Multiplication(A=cv_2, B=100)
rr = Set(division_3)
rr_2 = Get(rr)
panel_52 = Panel(rr_2)
# 3d
lines_all_4 = Get(lines_all)
filters_2 = Get(filters)
filters_3 = Get(filters)

end_4 = EndPoints(Curve=lines_all_4)  # -> Start, End
width_6 = Get(width)
merge_16 = Merge(Data1=end_4.Start, Data2=end_4.End)
len_3 = Length(Curve=lines_all_4)
repeat = RepeatData(Data=width_6, Length=len_3)  # -> flatten(Data)

cull_3 = CullPattern(List=lines_all_4, CullPattern=filters_2)
panel_53 = Panel(filters_3)
duppt_3 = RemoveDuplicatePts(Points=merge_16, Tolerance=0.01)
division_5 = Division(A=width_6, B=2)
pl = PlaneNormal(Origin=duppt_3, ZAxis=Vector(0, 0, 1))
geodesicdomerodgenerator = GeodesicDomeRodGenerator(
    Curves=cull_3,
    Points=duppt_3,
    JointPlanes=pl,
    BoardThickness=width_6,
    RodWidth=division_5,
    RodHeight=width_6,
    Tolerance="1")  # -> FaceTriBoards, FaceTriPlanes, FaceTriBoardTypeIds, IsTypicalFaceTriBoard, FaceTriRods, FaceTriRodsPlanes, FaceTriRodTypeIds, IsTypicalFaceTriRod
facetriboards = Set(geodesicdomerodgenerator.FaceTriBoards)
facetriplanes = Set(geodesicdomerodgenerator.FaceTriPlanes)
facetritypeids = Set(geodesicdomerodgenerator.FaceTriBoardTypeIds)
facetritypeids_2 = Get(facetritypeids)
counter = Counter(Integers=flatten(facetritypeids_2))
istypicalfacetriboard = Set(geodesicdomerodgenerator.IsTypicalFaceTriBoard)
facetrirods = Set(geodesicdomerodgenerator.FaceTriRods)
facetrirodplanes = Set(geodesicdomerodgenerator.FaceTriRodsPlanes)
facetrirodtypeids = Set(geodesicdomerodgenerator.FaceTriRodTypeIds)
facetrirodtypeids_2 = Get(flatten(facetrirodtypeids))
cull_4 = CullPattern(List=facetrirodtypeids_2, CullPattern=filters_3)
facetrirodtypeids_3 = Get(facetrirodtypeids)
counter_2 = Counter(Integers=flatten(facetrirodtypeids_3))
istypicalfacetrirod = Set(geodesicdomerodgenerator.IsTypicalFaceTriRod)
facetricounts = Set(counter)
facetricounts_2 = Get(facetricounts)
lng_3 = ListLength(List=flatten(facetricounts_2))
facetrirodcounts = Set(counter_2)
facetrirodcounts_2 = Get(flatten(facetrirodcounts))
panel_54 = Panel(facetrirodcounts_2)
mass_addition = MassAddition(Input=panel_54)  # -> Result, PartialResults
facetrirodcounts_3 = Get(facetrirodcounts)
lng_4 = ListLength(List=flatten(facetrirodcounts_3))
facetrirodtypecounts = Set(lng_4)
facetrirodtypecounts_2 = Get(facetrirodtypecounts)
panel_55 = Panel(facetrirodtypecounts_2)
facetritypecounts = Set(lng_3)
facetritypecounts_2 = Get(facetritypecounts)
panel_56 = Panel(facetritypecounts_2)
len_4 = Length(Curve=line_3)

load_combination_2_2 = Panel("""1.2
0
1.4
0
0.84
0""")
load_combination_3_2 = Panel("""1.2
0
1.4
0
0
0.84""")
load_combination_1_2 = Panel("""1
1.4
0
0
0
0""")
l = Number(len_4)

brep = Brep(facetrirods)
facetrirodtypeids_4 = Get(facetrirodtypeids)
facetrirodplanes_2 = Get(facetrirodplanes)
facetrirodtypeids_5 = Get(facetrirodtypeids)
facetrirodtypeids_6 = Get(facetrirodtypeids)
facetriplanes_2 = Get(facetriplanes)
facetrirods_2 = Get(facetrirods)
facetrirodplanes_3 = Get(facetrirodplanes)
istypicalfacetrirod_2 = Get(istypicalfacetrirod)
istypicalfacetriboard_2 = Get(istypicalfacetriboard)
lines_all_5 = Get(lines_all)
facetrirods_3 = Get(facetrirods)
facetriboards_2 = Get(facetriboards)
facetriplanes_3 = Get(facetriplanes)
istypicalfacetriboard_3 = Get(istypicalfacetriboard)
facetritypeids_3 = Get(facetritypeids)
facetriplanes_4 = Get(facetriplanes)
len_5 = Length(Curve=lines_all_5)
path_mapper = PathMapper(facetrirodtypeids_5, source="{A;B}", target="{A}")
path_mapper_2 = PathMapper(facetrirodplanes_2, source="{A;B}", target="{A}")
path_mapper_3 = PathMapper(facetrirodtypeids_4, source="{A;B}", target="{A}")
maxmin_5 = MaxMin(Numbers=len_5)  # -> Min, Max
item_7 = ListItem(List=flatten(brep), Index=number_slider, Wrap=True)  # disabled
cull_5 = CullPattern(List=facetrirodtypeids_6, CullPattern=istypicalfacetrirod_2)
cull_6 = CullPattern(List=facetrirodplanes_3, CullPattern=istypicalfacetrirod_2)
cull_7 = CullPattern(List=facetrirods_3, CullPattern=istypicalfacetrirod_2)
debrep = DeconstructBrep(Brep=item_7)  # -> Faces, Edges, Vertices; disabled
max_length = Set(maxmin_5.Max)
max_length_2 = Get(max_length)
panel_57 = Panel(max_length_2)

cull_8 = CullPattern(List=facetriboards_2, CullPattern=istypicalfacetriboard_3)
cull_9 = CullPattern(List=facetriplanes_3, CullPattern=istypicalfacetriboard_3)

item_8 = ListItem(List=debrep.Vertices, Index=0, Wrap=True)  # -> Item, Item1, Item2, Item3, Item4, Item5, Item6, Item7; disabled
item_9 = ListItem(List=debrep.Vertices, Index=0, Wrap=True)  # -> Item, Item1, Item2; disabled
deplane = DeconstructPlane(Plane=cull_6)  # -> Origin, XAxis, YAxis, ZAxis
pl_3pt_8 = Plane3Pt(PointA=item_9.Item, PointB=item_9.Item1, PointC=item_9.Item2)  # disabled
xy_5 = XYPlane(Origin=item_8.Item1)  # disabled
pl_2 = ConstructPlane(Origin=deplane.Origin, XAxis=deplane.XAxis, YAxis=deplane.ZAxis)
pl_3pt_9 = Plane3Pt(PointA=item_8.Item, PointB=item_8.Item1, PointC=item_8.Item4)  # disabled
project = Project(Geometry=item_8.Item, Plane=xy_5)  # -> Geometry, Transform; disabled
project_2 = Project(Geometry=item_8.Item4, Plane=xy_5)  # -> Geometry, Transform; disabled
angle_3 = Angle(VectorA=pl_3pt_9, VectorB=X)  # -> Angle, Reflex; disabled
ln_4 = Line(StartPoint=item_8.Item)  # disabled
concat = Concatenate(FragmentA="⬆", FragmentB=cull_5)

text_contours_3d = TextContours3D(Pl=pl_2, T=concat, S="0.1", font="Calibri", style=Slider(0, range=0..3), J=Slider(5, range=0..10))  # -> C; inputs Pl: Plane, T: String, S: Double, font: String, style: Int32, J: Int32
# ---------- text_contours_3d: C# usings ----------
using System.IO;
using System.Linq;
using System.Data;
using System.Drawing;
using System.Reflection;
using System.Windows.Forms;
using System.Xml;
using System.Xml.Linq;
using System.Runtime.InteropServices;

using Rhino.DocObjects;
using Rhino.Collections;
using GH_IO;
using GH_IO.Serialization;
# ---------- text_contours_3d: C# ----------
    Component.Name = "Text Contours 3D";
    Component.Params.First(p => p.Name == "J").Description = @"
      0: Top Left
      1: Top Center
      2: Top Right
      3: Middle Left
      4: Middle Center
      5: Middle Right
      6: Bottom Left
      7: Bottom Center
      8: Bottom Right";
    Component.Params.First(p => p.Name == "style").Description = @"
      0: Regular
      1: Bold
      2: Italic
      3: Bold Italic";
    bool bold = style == 1 || style == 3;
    bool italic = style == 2 || style == 3;
    int tmb = 1 << (16 + 2 - J / 3);
    int lcr = 1 << (J % 3);

    TextEntity _text = new TextEntity();
    _text.Plane = Pl;
    _text.Text = (T == null) ? "" : T;
    _text.TextHeight = (S <= 0) ? 1 : S;
    _text.FontIndex = RhinoDoc.ActiveDoc.Fonts.FindOrCreate(font, bold, italic);
    _text.Justification = (TextJustification) (tmb | lcr);

    C = _text.Explode();
# ---------- end text_contours_3d ----------

srf4pt = _4PointSurface(CornerA=item_8.Item, CornerB=item_8.Item1, CornerC=project.Geometry)  # disabled
srf4pt_2 = _4PointSurface(CornerA=item_8.Item4, CornerB=item_8.Item5, CornerC=project_2.Geometry)  # disabled
multiplication_2 = Multiplication(A=angle_3.Angle, B=57.29577951)  # disabled
merge_17 = Merge(Data1=srf4pt, Data2=srf4pt_2)  # disabled
loft = Loft(Curves=merge_17, Options={Adjust=False, Closed=False, LoftEnds=0, LoftSimp=0, LoftType=0, Rebuild=10, Refit=0.01})  # disabled
transform = Transform(Geometry=loft)  # disabled
orient_4 = Orient(Geometry=cull_7, Source=cull_6, Target=yz)  # -> Geometry, Transform
orient_5 = Orient(Geometry=text_contours_3d, Source=cull_6, Target=yz)  # -> Geometry, Transform
orient_6 = Orient(Geometry=cull_8, Source=cull_9, Target=PlaneXY(0, 0, 0))  # -> Geometry, Transform
max_length_3 = Get(max_length)

# ---- group: TypicalRods
clean = CleanTree(RemoveNulls=True, RemoveInvalid=True, RemoveEmpty="true", Tree=orient_4.Geometry)
lng_5 = ListLength(List=flatten(clean))
series_2 = Series(Start=0, Step=1, Count=lng_5)  # -> simplify(graft(Series))
multiplication_3 = Multiplication(A=series_2, B=max_length_3)
multiplication_4 = Multiplication(A=multiplication_3, B=2)
X_7 = UnitX(Factor=multiplication_4)

# ----
max_length_4 = Get(max_length)
max_length_5 = Get(max_length)

# ---- group: TypicalFaceTriBoards
clean_2 = CleanTree(RemoveNulls=True, RemoveInvalid=True, RemoveEmpty="true", Tree=orient_6.Geometry)
lng_6 = ListLength(List=flatten(clean_2))
series_3 = Series(Start=0, Step=1, Count=lng_6)  # -> simplify(graft(Series))
multiplication_5 = Multiplication(A=series_3, B=max_length_5)
multiplication_6 = Multiplication(A=multiplication_5, B=2)
X_8 = UnitX(Factor=multiplication_6)

# ----
max_length_6 = Get(max_length)
max_length_7 = Get(max_length)

# ---- group: TypicalRods
clean_3 = CleanTree(RemoveNulls=True, RemoveInvalid=True, RemoveEmpty="true", Tree=orient_5.Geometry)
lng_7 = ListLength(List=flatten(cull_5))
series_4 = Series(Start=0, Step=1, Count=lng_7)  # -> simplify(graft(Series))
multiplication_7 = Multiplication(A=series_4, B=max_length_7)
multiplication_8 = Multiplication(A=multiplication_7, B=2)
X_9 = UnitX(Factor=multiplication_8)

# ----
panel_58 = Panel(clean_3)
move_3 = Move(Geometry=clean_3, Motion=X_9)  # -> Geometry, Transform
move_4 = Move(Geometry=clean_2, Motion=X_8)  # -> Geometry, Transform
move_5 = Move(Geometry=clean, Motion=X_7)  # -> Geometry, Transform
geo_3 = Geometry(flatten(clean))
rot3d_5 = Rotate3D(Geometry=geo_3, Angle=expr("1.5 * Pi", 1.570796327), Center=Point(0, 0, 0), Axis=X_2)  # -> Geometry, Transform
move_6 = Move(Geometry=rot3d_5.Geometry, Motion=Z)  # -> Geometry, Transform
item_10 = ListItem(List=move_6.Geometry, Index=rod_type_2, Wrap=True)
cluster = Cluster_4(A_3="0", A_2="0", A="0", G=item_10)  # -> G_2, X
debrep_2 = DeconstructBrep(Brep=move_6.Geometry)  # -> Faces, Edges, simplify(Vertices)
debrep_3 = DeconstructBrep(Brep=cluster.G_2)  # -> Faces, Edges, Vertices
item_11 = ListItem(List=debrep_3.Vertices, Index=0, Wrap=True)  # -> Item, Item1, Item2; disabled
pl_3pt_10 = Plane3Pt(PointA=item_11.Item, PointB=item_11.Item1, PointC=item_11.Item2)  # disabled
flip = FlipMatrix(Data=debrep_2.Vertices)
item_12 = ListItem(List=debrep_3.Vertices, Index=0, Wrap=True)  # -> Item, Item1, Item2, Item3, Item4, Item5, Item6, Item7
createfrombox = CSharpScript(
    p1=item_12.Item,
    p2=item_12.Item,
    p3=item_12.Item2,
    p4=item_12.Item3,
    p5=item_12.Item4,
    p6=item_12.Item5,
    p7=item_12.Item6,
    p8=item_12.Item7)  # -> out, B; inputs p1: Point3d, p2: Point3d, p3: Point3d, p4: Point3d, p5: Point3d, p6: Point3d, p7: Point3d, p8: Point3d; disabled
# ---------- createfrombox: C# ----------
    Point3d[] vertices = new Point3d[8] { p1,p2,p3,p4,p5,p6,p7,p8 };
    B = Brep.CreateFromBox(vertices);
# ---------- end createfrombox ----------
branch = TreeBranch(Tree=flip, Path="7", MaintainPaths=True)
branch_2 = TreeBranch(Tree=flip, Path="0", MaintainPaths=True)
branch_3 = TreeBranch(Tree=flip, Path="4", MaintainPaths=True)
pt1 = Set(item_12.Item1)
pt0 = Set(item_12.Item)
pt2 = Set(item_12.Item2)
pt3 = Set(item_12.Item3)
pt4 = Set(item_12.Item4)
pt5 = Set(item_12.Item5)
pt6 = Set(item_12.Item6)
pt7 = Set(item_12.Item7)
pts = Set(debrep_3.Vertices)
pl_3pt_11 = Plane3Pt(PointA=branch_2, PointB=branch_3, PointC=branch)
dist = Distance(PointA=branch_2, PointB=branch_3)
panel_59 = Panel(dist)
angle_4 = Angle(VectorA=pl_3pt_11, VectorB=Y)  # -> expr("x*180/Pi", Angle), Reflex
angle_5 = Set(angle_4.Angle)
angle_6 = Get(angle_5)
panel_60 = Panel(angle_6)
pt4_2 = Get(pt4)
pt5_2 = Get(pt5)
pt6_2 = Get(pt6)
pt0_2 = Get(pt0)
pt1_2 = Get(pt1)
pt2_2 = Get(pt2)
pl_3pt_12 = Plane3Pt(PointA=pt4_2, PointB=pt5_2, PointC=pt6_2)
pl_3pt_13 = Plane3Pt(PointA=pt0_2, PointB=pt1_2, PointC=pt2_2)
angle_7 = Angle(VectorA=pl_3pt_12, VectorB=xy)  # -> Angle, Reflex
angle_8 = Angle(VectorA=pl_3pt_13, VectorB=xy_2)  # -> Angle, Reflex
sin = Sine(Value=angle_7.Angle)
sin_2 = Sine(Value=angle_8.Angle)
multiplication_9 = Multiplication(A=nut_radius_2, B=sin)
multiplication_10 = Multiplication(A=nut_radius_3, B=sin_2)
addition_8 = Addition(A=multiplication_9, B=nut_height_2)
addition_9 = Addition(A=multiplication_10, B=nut_height_3)
pt4_3 = Get(pt4)
pt5_3 = Get(pt5)
pt6_3 = Get(pt6)
pt7_2 = Get(pt7)
pt2_3 = Get(pt2)
pt3_2 = Get(pt3)
pt0_3 = Get(pt0)
pt5_4 = Get(pt5)
pt0_4 = Get(pt0)
pt1_3 = Get(pt1)
pt1_4 = Get(pt1)
pt4_4 = Get(pt4)
pt6_4 = Get(pt6)
pt2_4 = Get(pt2)
pt3_3 = Get(pt3)
pt7_3 = Get(pt7)
pt6_5 = Get(pt6)
pt4_5 = Get(pt4)
pt7_4 = Get(pt7)
pt5_5 = Get(pt5)
pt2_5 = Get(pt2)
pt3_4 = Get(pt3)
pt0_5 = Get(pt0)
pt1_5 = Get(pt1)
pts_2 = Get(pts)
pt0_6 = Get(pt0)
pt2_6 = Get(pt2)
pt4_6 = Get(pt4)
pt6_6 = Get(pt6)
pt7_5 = Get(pt7)
pt1_6 = Get(pt1)
pt3_5 = Get(pt3)
pt5_6 = Get(pt5)
cluster_2 = Cluster_7(pt=pt0_4, pt_2=pt1_3, pt_3=pt2_3, pt_4=pt3_2, num=bolt_length_3, depth_max=addition_9)  # -> pt_10, R_2, R, smaller_than
cluster_3 = Cluster_7(pt=pt4_3, pt_2=pt5_3, pt_3=pt6_3, pt_4=pt7_2, num=bolt_length_2, depth_max=addition_8)  # -> pt_10, R_2, R, smaller_than
cluster_4 = Cluster_7(pt=pt0_5, pt_2=pt1_5, pt_3=pt2_5, pt_4=pt3_4)  # -> pt_10, R_2, R, smaller_than
cluster_5 = Cluster_7(pt=pt4_5, pt_2=pt5_5, pt_3=pt6_5, pt_4=pt7_4)  # -> pt_10, R_2, R, smaller_than
cluster_6 = Cluster_3(pt_7=pt0_3, pt_8=pt1_4, pt_4=pt2_4, pt_2=pt3_3, pt_5=pt4_4, pt_6=pt5_4, pt_3=pt6_4, pt=pt7_3)  # -> P, P_2
cluster_7 = Cluster_9(pt=pts_2, num_2="150", num=width_5)  # -> P, P_2
merge_18 = Merge(Data1=cluster_7.P, Data2=cluster_7.P_2)  # disabled
orient_7 = Orient(Geometry=merge_18, Source=pl_3pt_10, Target=pl_3pt_8)  # -> Geometry, Transform; disabled
transform_2 = Transform(Geometry=merge_18)  # disabled
cluster_8 = Cluster_2(pt=pt0_6, pt_2=pt1_6, pt_3=pt2_6, pt_4=pt3_5, l0="142", l1="90.24")
cluster_9 = Cluster_2(pt=pt4_6, pt_2=pt5_6, pt_3=pt6_6, pt_4=pt7_5, l0="142", l1="90.24")
ln_5 = Line(StartPoint=pt3_5, EndPoint=pt7_5)
pflip = FlipPlane(Plane=cluster_3.R, ReverseX=toggle, ReverseY=toggle, SwapAxes=True)
pflip_2 = FlipPlane(Plane=cluster_9, ReverseX=toggle_2, ReverseY=toggle_2, SwapAxes=True)
ln_6 = Line(StartPoint=pt0_6, EndPoint=pt4_6)
angle_9 = Angle(VectorA=ln_5, VectorB=ln_6)  # -> Angle, Reflex
and_2 = GateAnd(A=cluster_2.smaller_than, B=cluster_3.smaller_than)
pflip_3 = FlipPlane(Plane=cluster_5.R_2, ReverseX=toggle_3, ReverseY=toggle_3, SwapAxes=True)
ln_7 = Line(StartPoint=pt1_6, EndPoint=pt2_6)
eval = Evaluate(F="x*180/Pi", x=angle_9.Angle)
ln_8 = Line(StartPoint=pt0_6, EndPoint=pt3_5)
is_bolt_safe = Set(and_2)
is_bolt_safe_2 = Get(is_bolt_safe)
panel_61 = Panel(is_bolt_safe_2)
panel_62 = Panel(eval)
ext = ExtendCurve(Curve=ln_7, Type=0, Start="0", End="6.6")
ext_2 = ExtendCurve(Curve=ln_8, Type=0, Start="0", End="15.6")
orient_pln = OrientPlaneKUKAPrc(Plane=cluster_8, OrientPoint="0,1000,0")
orient_pln_2 = OrientPlaneKUKAPrc(Plane=pflip_2, OrientPoint="0,1000,0")
orient_pln_3 = OrientPlaneKUKAPrc(Plane=cluster_2.R, OrientPoint="0,1000,0")
orient_pln_4 = OrientPlaneKUKAPrc(Plane=pflip, OrientPoint="0,1000,0")
orient_pln_5 = OrientPlaneKUKAPrc(Plane=cluster_4.R_2, OrientPoint="0,1000,0")
orient_pln_6 = OrientPlaneKUKAPrc(Plane=pflip_3, OrientPoint="0,1000,0")
orient_pln_7 = OrientPlaneKUKAPrc(Plane=cluster_7.P, OrientPoint="0,1000,0")
orient_pln_8 = OrientPlaneKUKAPrc(Plane=cluster_7.P_2, OrientPoint="0,1000,0")
lin_move = KUKAPrcLINearMovement(TargetAsPlane=orient_pln_3, Speed=merge_3, extaxenabled=False, interpolation="C_DIS")
lin_move_2 = KUKAPrcLINearMovement(TargetAsPlane=orient_pln_4, Speed=merge_3, extaxenabled=False, interpolation="C_DIS")
lin_move_3 = KUKAPrcLINearMovement(TargetAsPlane=orient_pln, Speed=merge_4, extaxenabled=False, interpolation="C_DIS")
lin_move_4 = KUKAPrcLINearMovement(TargetAsPlane=orient_pln_5, Speed=merge_3, extaxenabled=False, interpolation="C_DIS")
lin_move_5 = KUKAPrcLINearMovement(TargetAsPlane=orient_pln_6, Speed=merge_3, extaxenabled=False, interpolation="C_DIS")
lin_move_6 = KUKAPrcLINearMovement(TargetAsPlane=orient_pln_7, Speed=merge_3, extaxenabled=False, interpolation="C_DIS")
lin_move_7 = KUKAPrcLINearMovement(TargetAsPlane=orient_pln_2, Speed=merge_4, extaxenabled=False, interpolation="C_DIS")
lin_move_8 = KUKAPrcLINearMovement(TargetAsPlane=orient_pln_8, Speed=merge_3, extaxenabled=False, interpolation="C_DIS")
tool_axis_offset = KUKAPrcToolAxisOffset(KUKAPrcCommand=lin_move_3, OffsetAlongToolaxis="80", OffsetStart=True, OffsetEnd=True)
tool_axis_offset_2 = KUKAPrcToolAxisOffset(KUKAPrcCommand=lin_move, OffsetAlongToolaxis=50, OffsetStart=True, OffsetEnd=True)
tool_axis_offset_3 = KUKAPrcToolAxisOffset(KUKAPrcCommand=lin_move_2, OffsetAlongToolaxis=50, OffsetStart=True, OffsetEnd=True)
tool_axis_offset_4 = KUKAPrcToolAxisOffset(KUKAPrcCommand=lin_move_6, OffsetAlongToolaxis=50, OffsetStart=True, OffsetEnd=True)
tool_axis_offset_5 = KUKAPrcToolAxisOffset(KUKAPrcCommand=lin_move_4, OffsetAlongToolaxis=50, OffsetStart=True, OffsetEnd=True)
tool_axis_offset_6 = KUKAPrcToolAxisOffset(KUKAPrcCommand=lin_move_5, OffsetAlongToolaxis=50, OffsetStart=True, OffsetEnd=True)
tool_axis_offset_7 = KUKAPrcToolAxisOffset(KUKAPrcCommand=lin_move_7, OffsetAlongToolaxis="80", OffsetStart=True, OffsetEnd=True)
tool_axis_offset_8 = KUKAPrcToolAxisOffset(KUKAPrcCommand=lin_move_8, OffsetAlongToolaxis=50, OffsetStart=True, OffsetEnd=True)
merge_19 = Merge(Data1=flatten(fetch_3), Data2=flatten(tool_axis_offset_2), Data3=flatten(tool_axis_offset_3), Data4=flatten(return_3))
merge_20 = Merge(Data1=flatten(fetch), Data2=flatten(tool_axis_offset), Data3=flatten(tool_axis_offset_7), Data4=flatten(return))
merge_21 = Merge(
    Data1=flatten(fetch_2),
    Data2=flatten(tool_axis_offset_4),
    Data3=flatten(tool_axis_offset_8),
    Data4=flatten(tool_axis_offset_5),
    Data5=flatten(tool_axis_offset_6),
    Data6=flatten(return_2))
merge_22 = Merge(Data1=merge_20, Data2=merge_21, Data3=merge_19, Data4=krl_code)
item_13 = ListItem(List=cluster_7.P, Index=0, Wrap=True)  # disabled
item_14 = ListItem(List=cluster_7.P_2, Index=0, Wrap=True)  # disabled
item_15 = ListItem(List=cluster_7.P, Index=0, Wrap=True)  # disabled
item_16 = ListItem(List=cluster_7.P_2, Index=0, Wrap=True)  # disabled
move_7 = Move(Geometry=item_16, Motion=panel_34)  # -> Geometry, Transform; disabled
move_8 = Move(Geometry=item_15, Motion=panel_33)  # -> Geometry, Transform; disabled
cluster_10 = Cluster_10(G=item_14, offset=panel_35, vel=speed_move_4, vel_2=speed_move_4)
cluster_11 = Cluster_10(G=move_7.Geometry, offset="50", vel=speed_move_5, vel_2=speed_move_5)
kuka_prc = KUKAPrcCORE(
    SimulationSlider=panel_32,
    KUKAPrcCommands=merge_22,
    KUKAPrcTool=tool_1_5,
    KUKAPrcRobot=kr90_kr270_r2700,
    PRC_BaseExpose=False,
    PRC_SaveNameExpose=False,
    PRCsettings="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")  # -> RobotGeometry, AnalysisOutput
mesh_3 = Mesh(kuka_prc.RobotGeometry)  # disabled
clean_4 = CleanTree(RemoveNulls=True, RemoveInvalid=True, RemoveEmpty=False, Tree=mesh_3)  # disabled
item_17 = ListItem(List=flatten(clean_4), Index=0, Wrap=True)  # -> Item, Item1, Item2, Item3, Item4, Item5, Item6, Item7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; disabled
merge_23 = Merge(Data1=item_17.Item13, Data2=item_17.Item, Data3=item_17.Item1, Data4=item_17.Item9, Data5=item_17.Item12)  # disabled
merge_24 = Merge(Data1=item_17.Item2, Data2=item_17.Item4, Data3=item_17.Item7, Data4=item_17.Item11, Data5=item_17.Item14)  # disabled
merge_25 = Merge(Data1=item_17.Item3, Data2=item_17.Item5, Data3=item_17.Item6, Data4=item_17.Item8, Data5=item_17.Item10)  # disabled
preview = CustomPreview(Geometry=merge_25, Material=orange_2)  # disabled
preview_2 = CustomPreview(Geometry=merge_23, Material=aluminium_2)  # disabled
preview_3 = CustomPreview(Geometry=merge_24, Material=black_2)  # disabled

shell_height_2 = Get(shell_height)
panel_63 = Panel(shell_height_2)
panel_64 = Panel(multiplication)

ln_9 = Line(StartPoint=cull_i_5, EndPoint=cull_i_6)  # disabled
firstplane_2 = Get(firstplane)  # disabled

# ---- group: Sub Arc Division
panel_65 = Panel("1")  # disabled
series_5 = Series(Start=panel_65, Step=1, Count=n_5)  # disabled
divide_4 = DivideCurve(Curve=ln_9, Count=series_5, Kinks=False)  # -> simplify(Points), Tangents, Parameters; disabled

# ----
ln_10 = Line(StartPoint=original_2, EndPoint=divide_4.Points)  # disabled
slx = SurfaceLine(Surface=sph, Line=ln_10, LimitToFirst=False)  # -> Curves, Points, UVPoints, Normal; disabled
path_mapper_4 = PathMapper(slx.Points, source="{A;B}", target="{A}")  # disabled
pdecon_6 = Deconstruct(Point=path_mapper_4)  # -> XComponent, YComponent, ZComponent; disabled
larger_4 = LargerThan(FirstNumber=pdecon_6.ZComponent, SecondNumber=0)  # -> LargerThan, OrEqualTo; disabled
cull_10 = CullPattern(List=path_mapper_4, CullPattern=larger_4.LargerThan)  # disabled

# ---- group: Connect Chord
rev = ReverseList(List=cull_10)  # disabled
path_mapper_5 = PathMapper(rev, source="{A}(i)", target="{i}")  # disabled
path_mapper_6 = PathMapper(cull_10, source="{A}(i)", target="{i}")  # disabled
firstpoint_4 = Get(firstpoint)  # disabled
firstpoint_5 = Get(firstpoint)  # disabled
merge_26 = Merge(Data1=firstpoint_4, Data2=path_mapper_5)  # disabled
merge_27 = Merge(Data1=firstpoint_5, Data2=path_mapper_6)  # disabled
mkline = MKLine(Points=cull_10)  # disabled
mkline_2 = MKLine(Points=merge_26)  # disabled
mkline_3 = MKLine(Points=merge_27)  # disabled
merge_28 = Merge(Data1=mkline, Data2=mkline_3, Data3=mkline_2)  # disabled

# ----
divided_regular_icosahedron = Set(merge_28)  # disabled
divided_regular_icosahedron_2 = Get(divided_regular_icosahedron)  # disabled
basicshape = Geometry(divided_regular_icosahedron_2)  # disabled
mirror = Mirror(Geometry=basicshape, Plane=firstplane_2)  # -> Geometry, Transform; disabled
merge_29 = Merge(Data1=basicshape, Data2=mirror.Geometry)  # disabled

# ---- group: 4 layer
xy_6 = XYPlane(Origin=Point(0, 0, 0))  # disabled
mirror_2 = Mirror(Geometry=merge_29, Plane=xy_6)  # -> Geometry, Transform; disabled
panel_66 = Panel("-pi/5")  # disabled
rot3d_6 = Rotate3D(Geometry=mirror_2.Geometry, Angle=panel_66, Center=Point(0, 0, 0), Axis=Vector(0, 0, 1))  # -> Geometry, Transform; disabled
merge_30 = Merge(Data1=basicshape, Data2=rot3d_6.Geometry, Data3=mirror.Geometry)  # disabled

# ---- group: ArrPolar
panel_67 = Panel("5")  # disabled
arrpolar = PolarArray(Geometry=merge_30, Plane=PlaneXY(0, 0, 0), Count=panel_67, Angle=6.283185307)  # -> Geometry, Transform; disabled

# ----
geo_4 = Geometry(arrpolar.Geometry)  # disabled
scale_5 = Scale(Geometry=geo_4, Center=Point(0, 0, 0), Factor=radius_5)  # -> flatten(Geometry), Transform; disabled
end_5 = EndPoints(Curve=scale_5.Geometry)  # -> Start, End; disabled
merge_31 = Merge(Data1=end_5.Start, Data2=end_5.End)  # disabled
duppt_4 = RemoveDuplicatePts(Points=merge_31, Tolerance=panel_46)  # disabled
convexhull_7 = _3DConvexHull(Points=duppt_4)  # disabled
mesh_4 = Mesh(convexhull_7)  # disabled
pt_6 = Point(duppt_4)  # disabled
line_5 = Line(scale_5.Geometry)  # disabled

# ---- group: Structure
panel_68 = Panel("Glubam")

# ----
matprops = MaterialPropertiesKaramba3D(
    FamilyOfMaterial=panel_68,
    Name=panel_68,
    YoungsModulus_kN_cm2="1050",
    InPlaneShearModulus_kN_cm2="4.0385e2",
    TransverseShearModulus_kN_cm2="4.0385e2",
    SpecificWeight_kN_m3="7.2652",
    CoefficientOfThermalExpansion_1_C="2e-6",
    YieldStrength_kN_cm2=23.5,
    mode="Isotrop")
cross_section = CrossSectionKaramba3D(
    FamilyNameOfCrossSection="DefaultCroSec",
    Material=matprops,
    Height_cm=expr("x/10", box_b_0_3),
    UpperFlangeWidth_cm=expr("x/10", box_h_0_3),
    LowerFlangeWidth_cm=expr("x/10", box_h_0_3),
    mode="Trapezoid")

# ---- group: Structure (continued)
linetobeam = LineToBeamKaramba(
    Line=line_3,
    Identifier="Glubam",
    CrossSection=cross_section,
    New=True,
    Remove=True,
    LimitDistance_m=0.005,
    Bending=Toggle(False))  # -> Element, Points, Info

# ----
joint_agent = BeamJointAgentKaramba3D(ToGeometry=linetobeam.Points, Ct_kN_m=panel_25, Cr_kNm_rad=panel_25, menu=[buttons(off, off, off, off, off, off)])
beam_joints = BeamJointsKaramba3D(
    ElementIdentifiers=linetobeam.Element,
    CtKNMAtStartingNode=panel_25,
    CrKNmRadAtStartingNode=panel_25,
    CtKNMAtEndNode=panel_25,
    CrKNmRadAtEndNode=panel_25,
    menu=[buttons(on, on, on, on, on, on), buttons(on, on, on, on, on, on)])
beam_joints_2 = BeamJointsKaramba3D(
    ElementIdentifiers=linetobeam.Element,
    CtKNMAtStartingNode=Vector(0, 0, 0),
    CrKNmRadAtStartingNode=Vector(0, 0, 0),
    CtKNMAtEndNode=Vector(0, 0, 0),
    CrKNmRadAtEndNode=Vector(0, 0, 0),
    menu=[buttons(off, off, off, off, off, off), buttons(off, off, off, off, off, off)])
panel_69 = Panel(beam_joints)

# ---- group: ElongationPreview
len_6 = Length(Curve=line_4)
maxmin_6 = MaxMin(Numbers=len_6)  # -> Min, Max
gradient = Gradient(
    LowerLimit=maxmin_6.Min,
    UpperLimit=maxmin_6.Max,
    Parameter=len_6,
    stops=[0: RGB(234, 38, 0), 0.25: RGB(234, 126, 0), 0.5: RGB(254, 244, 84), 0.75: RGB(173, 203, 249), 1: RGB(75, 107, 169)])

# ----
gradient_2 = Gradient(
    LowerLimit=maxmin_6.Min,
    UpperLimit=maxmin_6.Max,
    Parameter=len_6,
    stops=[0: RGB(234, 38, 0), 0: RGB(254, 244, 84), 0: RGB(234, 126, 0), 0: RGB(234, 38, 0), 1: RGB(75, 107, 169)])

# ---- group: ElongationPreview (continued)
material = CreateMaterial(Diffuse=gradient_2, Specular=RGB(255, 255, 255), Emission=RGB(0, 0, 0), Transparency=0, Shine=0)
preview_4 = CustomPreview(Geometry=line_4, Material=material)

# ----
assemble = AssembleModelKaramba(Elem=linetobeam.Element, Support=flatten(merge_15), Load=loads, LimitDistance_m=0.005)  # -> Model, Info, Mass_kg, CenterOfGravity
subtraction_11 = Subtraction(A="1.0", B="1.7")
division_6 = Division(A=subtraction_11, B="360")
series_6 = Series(Start="1.7", Step=division_6, Count="360")
hsl = ColourHSL(Alpha=1, Hue=series_6, Saturation=1, Luminance=0.5)

panel_70 = Panel(assemble.Mass_kg)
analyzenonlin_wip = AnalyzeNonlinearWIPKaramba3D(
    Model=assemble.Model,
    NumberOfLoadSteps="1000",
    InitialLoadFactor=0.2,
    MaxNumberOfEquilibriumIterations=50,
    TargetNumberOfEquilibriumIterations=10,
    EquilibriumTolerance=1e-07,
    MaxNumberOfLoadIncrements=30,
    mode="ArcLength")  # -> CalculatedModel, MaximumDisplacement_cm, ElasticEnergy_kNm, Info, Lambdas
analyzethii = AnalyzeThIIKaramba3D(Model=assemble.Model, LoadCase=-1, RTolerance=1e-07, MaxIterations=50, NoTensionalNII=False)  # -> CalculatedModel, MaximumDisplacement_cm, ResultingForceOfGravity_kN, ElasticEnergy_kNm
emodes = EigenModesKaramba3D(Model=assemble.Model, FromIndex=Slider(1, range=0..10), NumberOfModes="10", MaximumNumberOfIterations=300, Epsilon=1e-07)  # -> ModelWithEigenModesAsLoadCaseResults, Eigenvalues
modelview = ModelViewKaramba3D(Model=emodes.ModelWithEigenModesAsLoadCaseResults, LoadCaseFactorsForLinearSuperposition=1, IndexOfVisibleLoadcase=-1)  # -> Model, DeformedMesh, DeformedAxes, DeformedModel
sqrt_2 = SquareRoot(Value=emodes.Eigenvalues)
eval_2 = Evaluate(F="2*pi/x", x=sqrt_2)
panel_71 = Panel(emodes.Eigenvalues)
panel_72 = Panel(eval_2)

modelview_2 = ModelViewKaramba(
    Model=analyzenonlin_wip.CalculatedModel,
    LoadCaseFactorsForLinearSuperposition=load_combination_3,
    IndexOfVisibleLoadcase=-1,
    ListOfColorsForColoringPlots=hsl)  # -> Model, DeformedMesh, DeformedAxes, DeformedModel

beamview = BeamViewKaramba3D(Model=modelview_2.Model)  # -> Model, MeshesOfRenderedBeams, DeformedBeamAxes, LegendColors, LegendTags

legend = Legend(Colour=beamview.LegendColors, Tags=beamview.LegendTags, LegendType=1)

# ---- group: 0
series_7 = Series(Start=0, Step=1, Count=lng)
b_forces = BeamForcesKaramba(
    AnalyzedModel=beamview.Model,
    BeamIdentifiers="Glubam",
    LCase=series_7,
    MaximumDistanceBetweenResults_m=-1,
    NumberOfResultsPerBeamElement=2)  # -> AnalyzedModel, simplify(NormalForce_kN), ShearForceVz_kN, ShearForceVy_kN, BendingMomentMt_kNm, BendingMomentMy_kNm, BendingMomentMz_kNm
c_script_6 = CSharpScript(b=box_b_0_2, h=box_h_0_2)  # -> out, Ix, ix, A; inputs b: Double, h: Double
# ---------- c_script_6: C# ----------
    double _Ix = b * h * h * h / 12;
    double _ix = Math.Sqrt(_Ix / b / h);
    Ix = _Ix;
    ix = _ix;
    double _A = b * h;
    A = _A;
# ---------- end c_script_6 ----------
panel_73 = Panel("""False
True""")
cull_11 = CullPattern(List=b_forces.NormalForce_kN, CullPattern=panel_73)
cluster_12 = Cluster_8(lcomb1=load_combination_1_2, lcomb2=load_combination_2_2, lcomb3=load_combination_3_2, N=cull_11)  # -> min, max, L
abs_2 = Absolute(Value=cluster_12.min)
panel_74 = Panel("D:\Users\Mark\Documents\Mark\Work\Zhejiang University\20180926 Bridge\output.xlsx")
multiplication_11 = Multiplication(A=abs_2, B="1000")
safety = Panel("3.3")
c_script_7 = CSharpScript(ix=c_script_6.ix, l=l, F=multiplication_11, fa="68e6", A=c_script_6.A, safety=safety)  # -> out, lambda, varphi, Fa, Fasafe, f, utilization; inputs ix: Double, l: Double, F: Double, fa: Double, A: Double, safety: Double
# ---------- c_script_7: C# ----------
    double _lambda = l / ix;
    lambda = _lambda;
    double _varphi = 0;
    if (_lambda > 75){
      _varphi = 3000 / _lambda / _lambda;
    }
    else{
      _varphi = 1 / (1 + (_lambda / 80) * (_lambda / 80));
    }
    varphi = _varphi;

    double _Fa = _varphi * fa * A;
    double _Fasafe = _Fa / safety;
    Fa = _Fa;
    Fasafe = _Fasafe;

    double _f = F / A;
    f = _f;
    double _utilization = F / _Fa * safety;
    utilization = _utilization;
# ---------- end c_script_7 ----------
c_script_8 = CSharpScript(x=multiplication_11, y=c_script_7.Fasafe)  # -> out, A; inputs x: Double, y: Double
# ---------- c_script_8: C# ----------
    if (x > y || x == 0){
      A = 10;
    }else{
      A = 0;
    }
# ---------- end c_script_8 ----------
merge_32 = Merge(
    Data1=box_b_0_2,
    Data2=c_script_6.A,
    Data3=multiplication_11,
    Data4=c_script_7.Fa,
    Data5=c_script_7.f,
    Data6=c_script_7.utilization)  # disabled
panel_75 = Panel("""a
A
F
Fa
f
ultilization""")
multiplication_12 = Multiplication(A=cluster_12.L, B=c_script_6.A)
flip_2 = FlipMatrix(Data=merge_32)
addition_10 = Addition(A=c_script_8.A, B=multiplication_12)
excelwrite = ExcelWrite(
    WriteExcelData=Button(),
    WorkbookPath=panel_74,
    WorksheetName="Sheet1",
    ColumnHeadings=panel_75,
    Data=flip_2,
    ClearSheet=False)
num = Number(addition_10)
panel_76 = Panel(num)

# ----
maxmin_7 = MaxMin(Numbers=c_script_7.lambda)  # -> Min, Max
lambda_max = Set(maxmin_7.Max)
lambda_max_2 = Get(lambda_max)
panel_77 = Panel(lambda_max_2)
sort = SortList(Keys=c_script_7.utilization)  # -> Keys, ValuesA
rev_2 = ReverseList(List=sort.Keys)
maxmin_8 = MaxMin(Numbers=rev_2)  # -> Min, Max
utilization = Set(maxmin_8.Max)

utilization_2 = Get(utilization)
panel_78 = Panel(utilization_2)

path_mapper_7 = PathMapper(facetrirods_2, source="{A;B}", target="{A}")

lng_8 = ListLength(List=path_mapper_7)
repeat_2 = RepeatData(Data=facetriplanes_2, Length=lng_8)  # -> simplify(Data)

repeat_3 = RepeatData(Data=istypicalfacetriboard_2, Length=lng_8)  # -> simplify(Data)
cull_12 = CullPattern(List=path_mapper_7, CullPattern=repeat_3)
cull_13 = CullPattern(List=repeat_2, CullPattern=repeat_3)

cull_14 = CullPattern(List=path_mapper_2, CullPattern=repeat_3)
cull_15 = CullPattern(List=path_mapper, CullPattern=repeat_3)
deplane_2 = DeconstructPlane(Plane=cull_14)  # -> Origin, XAxis, YAxis, ZAxis
pl_3 = ConstructPlane(Origin=deplane_2.Origin, XAxis=deplane_2.XAxis, YAxis=deplane_2.ZAxis)
concat_2 = Concatenate(FragmentA="⬆", FragmentB=cull_15)

# ---- group: FaceTri Tag
panel_79 = Panel("100")
text_contours_3d_2 = TextContours3D(Pl=pl_3, T=concat_2, S=panel_79, font="Calibri", style=Slider(0, range=0..3), J=Slider(5, range=0..10))  # -> C; inputs Pl: Plane, T: String, S: Double, font: String, style: Int32, J: Int32; same code as text_contours_3d

tag = TextTag3D(Location=pl_3, Text=path_mapper_3, Size=panel_79, Justification=7)

# ----
repeat_4 = RepeatData(Data=cull_13, Length="3")  # -> simplify(graft(Data))
lng_9 = ListLength(List=text_contours_3d_2)
repeat_5 = RepeatData(Data=repeat_4, Length=lng_9)  # -> simplify(Data)

# ---- group: FaceTri Tag
concat_3 = Concatenate(FragmentA="⬆", FragmentB=facetritypeids_3)
panel_80 = Panel("100")

xy_7 = XYPlane(Origin=facetriplanes_4)
tag_2 = TextTag3D(Location=facetriplanes_4, Text=concat_3, Size=panel_80, Justification=7)

text_contours_3d_3 = TextContours3D(Pl=xy_7, T=concat_3, S=panel_80, font="Calibri", style=Slider(0, range=0..3), J=Slider(4, range=0..10))  # -> C; inputs Pl: Plane, T: String, S: Double, font: String, style: Int32, J: Int32; same code as text_contours_3d

orient_8 = Orient(Geometry=text_contours_3d_3, Source=graft(xy_7), Target=graft(facetriplanes_4))  # -> Geometry, Transform

# ---- group: TypicalFaceTriRods
orient_9 = Orient(Geometry=text_contours_3d_2, Source=repeat_5, Target=PlaneXY(0, 0, 0))  # -> Geometry, Transform
clean_5 = CleanTree(RemoveNulls=True, RemoveInvalid=True, RemoveEmpty="true", Tree=orient_9.Geometry)
lng_10 = ListLength(List=clean_5)  # -> flatten(Length)

# ----
lng_11 = ListLength(List=lng_10)
lng_12 = ListLength(List=clean_5)

# ---- group: TypicalFaceTriRods
orient_10 = Orient(Geometry=cull_12, Source=cull_13, Target=PlaneXY(0, 0, 0))  # -> Geometry, Transform
clean_6 = CleanTree(RemoveNulls=True, RemoveInvalid=True, RemoveEmpty="true", Tree=orient_10.Geometry)
lng_13 = ListLength(List=clean_6)  # -> flatten(Length)

# ----
lng_14 = ListLength(List=lng_13)

# ---- group: TypicalFaceTriRods (continued)
series_8 = Series(Start=0, Step=1, Count=expr("x/3", lng_11))
multiplication_13 = Multiplication(A=series_8, B=max_length_6)
multiplication_14 = Multiplication(A=multiplication_13, B=2)  # -> simplify(graft(Result))

# ----
repeat_6 = RepeatData(Data=multiplication_14, Length="3")  # -> simplify(graft(Data))
repeat_7 = RepeatData(Data=repeat_6, Length=lng_12)  # -> simplify(Data)

# ---- group: TypicalFaceTriRods (continued)
X_10 = UnitX(Factor=repeat_7)

# ----
move_9 = Move(Geometry=clean_5, Motion=X_10)  # -> Geometry, Transform

# ---- group: TypicalFaceTriRods (continued)
series_9 = Series(Start=0, Step=1, Count=lng_14)
multiplication_15 = Multiplication(A=series_9, B=max_length_4)
multiplication_16 = Multiplication(A=multiplication_15, B=2)  # -> simplify(graft(Result))

# ----
repeat_8 = RepeatData(Data=multiplication_16, Length="3")  # -> simplify(Data)

# ---- group: TypicalFaceTriRods (continued)
X_11 = UnitX(Factor=repeat_8)

# ----
move_10 = Move(Geometry=clean_6, Motion=X_11)  # -> Geometry, Transform

panel_81 = Panel("""1108.44,962.21,631.82
1828.18,964.43,632.26
1834.9,-1034.21,635.62
1115.21,-1036.24,636.27""")
pt_7 = Point(panel_28)
Z_4 = UnitZ(Factor="-25")
material_2 = CreateMaterial(Diffuse="200,200,200", Specular="200,200,200", Emission="36,36,36", Transparency=0, Shine="50")

addition_11 = Addition(A=pt_7, B=vec_3)
pt_8 = Point(addition_11)

pdecon_7 = Deconstruct(Point=pt_8)  # -> XComponent, YComponent, ZComponent
avr_4 = Average(Input=pdecon_7.ZComponent)
item_18 = ListItem(List=pt_8, Index=0, Wrap=True)  # -> Item, Item1, Item2, Item3
srf4pt_3 = _4PointSurface(CornerA=item_18.Item, CornerB=item_18.Item1, CornerC=item_18.Item2, CornerD=item_18.Item3)
extr = Extrude(Base=srf4pt_3, Direction=Z_4)
preview_5 = CustomPreview(Geometry=extr, Material=c_script_4)

pt_9 = Point(item_18.Item3)
vec2pt = Vector2Pt(PointA=pt_9, PointB=pt0_6, Unitize=False)  # -> Vector, Length
vec2pt_2 = Vector2Pt(PointA=pt_9, PointB="{-4.9836e-8, 3.7792e-7, 56}", Unitize=False)  # -> Vector, Length
panel_82 = Panel(vec2pt.Vector)
panel_83 = Panel(vec2pt_2.Vector)

Z_5 = UnitZ(Factor="28")
material_3 = CreateMaterial(Diffuse="255,215,100", Specular="255,215,100", Emission="0,0,0", Transparency=0, Shine="0")
extr_2 = Extrude(Base=srf4pt_3, Direction=Z_5)
preview_6 = CustomPreview(Geometry=extr_2, Material=c_script_5)

# ---- group: test_z
speed_move_6 = Get(speed_move)  # disabled
number_slider_8 = Slider(0.682, range=0..1)  # disabled
tool4_loc_3 = Get(tool4_loc)  # disabled
tool_4_3 = Get(tool_4)  # disabled
panel_84 = Panel("0")  # disabled
fetch_4 = Fetch(pt=tool4_loc_3, tool=tool_4_3, F=panel_84, wait=1)  # disabled
kr90_kr270_r2700_2 = QuantecKR90KR270R2700Robot(infiniterot=False)  # disabled
tool_1_6 = Get(tool_1)  # disabled

# ----
cluster_13 = Cluster_10(G=item_13, offset=panel_35, vel=speed_move_6, vel_2=speed_move_6)  # disabled

# ---- group: test_z (continued)
merge_33 = Merge(Data1=flatten(fetch_4), Data2=flatten(cluster_13), Data3=flatten(cluster_10))  # disabled
kuka_prc_2 = KUKAPrcCORE(
    SimulationSlider=number_slider_8,
    KUKAPrcCommands=merge_33,
    KUKAPrcTool=tool_1_6,
    KUKAPrcRobot=kr90_kr270_r2700_2,
    PRC_BaseExpose=False,
    PRC_SaveNameExpose=False,
    PRCsettings="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")  # -> RobotGeometry, AnalysisOutput; disabled

speed_move_7 = Get(speed_move)
tool2_loc_3 = Get(tool2_loc)
tool_2_3 = Get(tool_2)
fetch_5 = Fetch(pt=tool2_loc_3, tool=tool_2_3, F="0", wait=1)
kr90_kr270_r2700_3 = QuantecKR90KR270R2700Robot(infiniterot=False)
tool_1_7 = Get(tool_1)

# ----
cluster_14 = Cluster_10(G=move_8.Geometry, offset="50", vel=speed_move_7, vel_2=speed_move_7)

# ---- group: test_z (continued)
merge_34 = Merge(Data1=flatten(fetch_5), Data2=flatten(cluster_14), Data3=flatten(cluster_11))
kuka_prc_3 = KUKAPrcCORE(
    SimulationSlider=Slider(0.6053, range=0..1),
    KUKAPrcCommands=merge_34,
    KUKAPrcTool=tool_1_7,
    KUKAPrcRobot=kr90_kr270_r2700_3,
    PRC_BaseExpose=False,
    PRC_SaveNameExpose=False,
    PRCsettings="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")  # -> RobotGeometry, AnalysisOutput

# ==== cluster Index1
pt = ClusterInput()
pt_2 = Point(pt)
convexhull = _3DConvexHull(Points=pt_2)
facen = FaceNormals(Mesh=convexhull)  # -> Centers, Normals
R = ClusterInput()
line = LineSDL(Start="0,0,0", Direction=facen.Centers, Length=1)
sph = Sphere(Base=PlaneXY(0, 0, 0), Radius=R)
slx = SurfaceLine(Surface=sph, Line=line, LimitToFirst=False)  # -> Curves, Points, UVPoints, Normal
item = ListItem(List=slx.Points, Index=0, Wrap=True)
merge = Merge(Data1=pt_2, Data2=item)  # -> flatten(Result)
pt_3 = Point(merge)
pt_4 = ClusterOutput(pt_3)

# ==== cluster Cluster_2
pt = ClusterInput()
pt_2 = ClusterInput()
pt_3 = ClusterInput()
pt_4 = ClusterInput()
pt_5 = Point(pt)
pt_6 = Point(pt_2)
pt_7 = Point(pt_3)
pt_8 = Point(pt_4)
merge = Merge(Data1=pt_5, Data2=pt_6)
merge_2 = Merge(Data1=pt_7, Data2=pt_8)
pl_3pt = Plane3Pt(PointA=pt_5, PointB=pt_6, PointC=pt_7)
X = UnitX(Factor=1)
avr = Average(Input=merge)
avr_2 = Average(Input=merge_2)
xprod = CrossProduct(VectorA=X, VectorB=pl_3pt, Unitize=False)  # -> Vector, Length
ln = Line(StartPoint=avr, EndPoint=avr_2)
l0 = ClusterInput()
l1 = ClusterInput()
line = LineSDL(Start=avr_2, Direction=xprod.Vector, Length=ln)
end = EndPoints(Curve=line)  # -> Start, End
ln_2 = Line(StartPoint=end.End, EndPoint=end.Start)
ext = ExtendCurve(Curve=ln_2, Type=0, Start=l0, End=expr("-x", l1))
end_2 = EndPoints(Curve=ext)  # -> Start, End
pl = PlaneNormal(Origin=end_2.End, ZAxis=pl_3pt)
pl_2 = PlaneNormal(Origin=end_2.Start, ZAxis=pl_3pt)
cluster = Cluster(pln=pl)
cluster_2 = Cluster(pln=pl_2)
merge_3 = Merge(Data1=pl_2, Data2=pl, Data3=pl_2)
R = ClusterOutput(merge_3)

# ==== cluster Cluster_3
pt = ClusterInput()
pt_2 = ClusterInput()
pt_3 = ClusterInput()
pt_4 = ClusterInput()
pt_5 = ClusterInput()
pt_6 = ClusterInput()
pt_7 = ClusterInput()
pt_8 = ClusterInput()
pt_9 = Point(pt)
pt_10 = Point(pt_5)
pt_11 = Point(pt_3)
pt_12 = Point(pt_2)
pt_13 = Point(pt_6)
pt_14 = Point(pt_4)
pt_15 = Point(pt_7)
pt_16 = Point(pt_8)
merge = Merge(Data1=pt_15, Data2=pt_16, Data3=pt_14, Data4=pt_12, Data5=pt_10, Data6=pt_13, Data7=pt_11, Data8=pt_9)
depth_or = ClusterInput()
depth_or_2 = Number(depth_or)
pt_17 = Point(pt_4)
devec = DeconstructVector()  # -> XComponent, YComponent, ZComponent
avr = Average(Input=merge)
X = UnitX(Factor="150")
Y = UnitY(Factor="150")
rev = Reverse(Vector=Y)
move = Move(Geometry=avr, Motion=rev)  # -> Geometry, Transform
move_2 = Move(Geometry=avr, Motion=Y)  # -> Geometry, Transform
pdecon = Deconstruct(Point=pt_15)  # -> XComponent, YComponent, ZComponent
pdecon_2 = Deconstruct(Point=pt_17)  # -> XComponent, YComponent, ZComponent
Z = UnitZ(Factor=1)
rev_2 = Reverse(Vector=Z)
subtraction = Subtraction(A=pdecon.ZComponent, B=pdecon_2.ZComponent)
merge_2 = Merge(Data1=flatten(depth_or_2), Data2=flatten(subtraction))
item = ListItem(List=merge_2, Index=0, Wrap=True)
line = LineSDL(Start=move_2.Geometry, Direction=rev_2, Length=item)
line_2 = LineSDL(Start=move.Geometry, Direction=rev_2, Length=item)
ext = ExtendCurve(Curve=line, Type=0, Start="5", End="0")
ext_2 = ExtendCurve(Curve=line_2, Type=0, Start="5", End="0")
end = EndPoints(Curve=ext)  # -> Start, End
end_2 = EndPoints(Curve=ext_2)  # -> Start, End
merge_3 = Merge(Data1=end.Start, Data2=end.End, Data3=end.Start)
merge_4 = Merge(Data1=end_2.Start, Data2=end_2.End, Data3=end_2.Start)
xy = XYPlane(Origin=merge_3)
xy_2 = XYPlane(Origin=merge_4)
P = ClusterOutput(xy)
P_2 = ClusterOutput(xy_2)

# ==== cluster Cluster_4
panel = Panel("-84.73,-2.59,-28.57")
G = ClusterInput()
panel_2 = Panel("1000")
rotate = Rotate(Geometry=G, Angle=1.570796327, Plane=PlaneXY(0, 0, 0))  # -> Geometry, Transform
yz = YZPlane(Origin="1418.867902, 257.44712, 591")
A = ClusterInput()
A_2 = ClusterInput()
A_3 = ClusterInput()
vec = Vector("1500,0,610")
vec_2 = Vector("-84.73,-2.59,7.135")
vec_3 = Vector("0,0,0.17")
addition = Addition(A=vec, B=vec_2, C=vec_3)
move = Move(Geometry=rotate.Geometry, Motion=addition)  # -> Geometry, Transform
rotate_2 = Rotate(Geometry=move.Geometry, Angle="-0.0015", Plane=yz)  # -> Geometry, Transform
rot3d = Rotate3D(Geometry=move.Geometry, Angle=expr("-x", A_3), Center=Point(0, 0, 0), Axis=Vector(1, 0, 0))  # -> Geometry, Transform
rot3d_2 = Rotate3D(Geometry=rot3d.Geometry, Angle=expr("-x", A_2), Center=Point(0, 0, 0), Axis=Vector(0, 1, 0))  # -> Geometry, Transform
merge = Merge(Data1=rotate.Transform, Data2=move.Transform)
rot3d_3 = Rotate3D(Geometry=rot3d_2.Geometry, Angle=expr("-x", A), Center=Point(0, 0, 0), Axis=Vector(0, 0, 1))  # -> Geometry, Transform
comp = Compound(Transforms=merge)
G_2 = ClusterOutput(rot3d_3.Geometry)
X = ClusterOutput(comp)

# ==== cluster Fetch
panel = Panel(""";FOLD PULSE 3 'zheng zhuan' State=TRUE Time=0.3 sec;%{PE}%R 8.5.19,%MKUKATPBASIS,%COUT,%VPULSE,%P 2:3, 3:zheng zhuan, 5:TRUE, 6:, 8:0.3
PULSE($OUT[3], TRUE,0.3)
;ENDFOLD""")
pt = ClusterInput()
panel_2 = Panel(""";FOLD OUT 1 'jia jin' State=TRUE ;%{PE}%R 8.5.19,%MKUKATPBASIS,%COUT,%VOUTX,%P 2:1, 3:jia jin, 5:TRUE, 6:
$OUT[1]=TRUE
;ENDFOLD
;FOLD OUT 2 'da kai' State=FALSE ;%{PE}%R 8.5.19,%MKUKATPBASIS,%COUT,%VOUTX,%P 2:2, 3:da kai, 5:FALSE, 6:
$OUT[2]=FALSE
;ENDFOLD
;FOLD WAIT FOR ( IN 1 'jia jin' );%{PE}%R 8.5.19,%MKUKATPBASIS,%CEXT_WAIT_FOR,%VEXT_WAIT_FOR,%P 2:, 4:, 5:$IN, 6:1, 7:jia jin, 9:
WAIT FOR  ( $IN[1] ) 
;ENDFOLD""")
pt_2 = Point(pt)
panel_3 = Panel("""$OUT[7]=TRUE
FREQUENCY=""")
Y = UnitY(Factor="-150")
Z = UnitZ(Factor="100")
wait = ClusterInput()
F = ClusterInput()
move = Move(Geometry=pt_2, Motion=Y)  # -> Geometry, Transform
move_2 = Move(Geometry=pt_2, Motion=Z)  # -> Geometry, Transform
wait_2 = WaitKUKAPrc(KUKAPrcWait=wait)
F_2 = Number(F)
merge = Merge(Data1=move_2.Geometry, Data2=pt_2)
panel_4 = Panel(""";FOLD OUT 1 'jia jin' State=FALSE ;%{PE}%R 8.5.19,%MKUKATPBASIS,%COUT,%VOUTX,%P 2:1, 3:jia jin, 5:FALSE, 6:
$OUT[1]=FALSE
;ENDFOLD
;FOLD OUT 2 'da kai' State=TRUE ;%{PE}%R 8.5.19,%MKUKATPBASIS,%COUT,%VOUTX,%P 2:2, 3:da kai, 5:FALSE, 6:
$OUT[2]=TRUE
;ENDFOLD""")
Z_2 = UnitZ(Factor="300")
concat = Concatenate(FragmentA=panel_3, FragmentB=F_2, FragmentC=panel)
xy = XYPlane(Origin=move.Geometry)
cluster = Cluster_5(G=xy)
move_3 = Move(Geometry=cluster, Motion=Z_2)  # -> Geometry, Transform
xy_2 = XYPlane(Origin=merge)
cluster_2 = Cluster_5(G=xy_2)
tool = ClusterInput()
krl_code = KRLCodeKUKAPrc(KRLAsText=panel_2)
change_tool = ChangeToolKUKAPrc(KUKAPrcTool=tool)
lin_move = KUKAPrcLINearMovement(TargetAsPlane=cluster_2, Speed="2", extaxenabled=False, interpolation="C_DIS")
krl_code_2 = KRLCodeKUKAPrc(KRLAsText=panel_4)
lin_move_2 = KUKAPrcLINearMovement(TargetAsPlane=move_3.Geometry, Speed="2", extaxenabled=False, interpolation="C_DIS")
lin_move_3 = KUKAPrcLINearMovement(TargetAsPlane=cluster, Speed="2", extaxenabled=False, interpolation="C_DIS")
krl_code_3 = KRLCodeKUKAPrc(KRLAsText=concat)
merge_2 = Merge(
    Data1=flatten(krl_code_2),
    Data2=flatten(lin_move),
    Data3=flatten(krl_code),
    Data4=flatten(lin_move_3),
    Data5=flatten(change_tool),
    Data6=flatten(lin_move_2),
    Data7=flatten(krl_code_3),
    Data8=flatten(wait_2))
R = ClusterOutput(merge_2)

# ==== cluster Return
pt = ClusterInput()
pt_2 = Point(pt)
Y = UnitY(Factor="-150")
panel = Panel(""";FOLD OUT 1 'jia jin' State=FALSE ;%{PE}%R 8.5.19,%MKUKATPBASIS,%COUT,%VOUTX,%P 2:1, 3:jia jin, 5:FALSE, 6:
$OUT[1]=FALSE
;ENDFOLD
;FOLD OUT 2 'da kai' State=TRUE ;%{PE}%R 8.5.19,%MKUKATPBASIS,%COUT,%VOUTX,%P 2:2, 3:da kai, 5:TRUE, 6:
$OUT[2]=TRUE
;ENDFOLD
;FOLD WAIT FOR ( IN 2 'da kai' );%{PE}%R 8.5.19,%MKUKATPBASIS,%CEXT_WAIT_FOR,%VEXT_WAIT_FOR,%P 2:, 4:, 5:$IN, 6:2, 7:da kai, 9:
WAIT FOR  ( $IN[2] ) 
;ENDFOLD""")
Z = UnitZ(Factor="100")
move = Move(Geometry=pt_2, Motion=Y)  # -> Geometry, Transform
panel_2 = Panel(""";FOLD PULSE 5 'ting zhi' State=TRUE Time=0.3 sec;%{PE}%R 8.5.19,%MKUKATPBASIS,%COUT,%VPULSE,%P 2:5, 3:ting zhi, 5:TRUE, 6:, 8:0.3
PULSE($OUT[5], TRUE,0.3)
;ENDFOLD""")
move_2 = Move(Geometry=pt_2, Motion=Z)  # -> Geometry, Transform
merge = Merge(Data1=move.Geometry, Data2=pt_2)
Z_2 = UnitZ(Factor="300")
wait = ClusterInput()
xy = XYPlane(Origin=move.Geometry)
xy_2 = XYPlane(Origin=merge)
xy_3 = XYPlane(Origin=move_2.Geometry)
cluster = Cluster_6(G=xy)
wait_2 = WaitKUKAPrc(KUKAPrcWait=wait)
move_3 = Move(Geometry=cluster, Motion=Z_2)  # -> Geometry, Transform
cluster_2 = Cluster_6(G=xy_2)
cluster_3 = Cluster_6(G=xy_3)
tool = ClusterInput()
krl_code = KRLCodeKUKAPrc(KRLAsText=panel_2)
lin_move = KUKAPrcLINearMovement(TargetAsPlane=move_3.Geometry, Speed="2", extaxenabled=False, interpolation="C_DIS")
change_tool = ChangeToolKUKAPrc(KUKAPrcTool=tool)
lin_move_2 = KUKAPrcLINearMovement(TargetAsPlane=cluster_2, Speed="2", extaxenabled=False, interpolation="C_DIS")
krl_code_2 = KRLCodeKUKAPrc(KRLAsText=panel)
lin_move_3 = KUKAPrcLINearMovement(TargetAsPlane=cluster_3, Speed="2", extaxenabled=False, interpolation="C_DIS")
merge_2 = Merge(
    Data1=flatten(krl_code),
    Data2=flatten(wait_2),
    Data3=flatten(lin_move),
    Data4=flatten(change_tool),
    Data5=flatten(lin_move_2),
    Data6=flatten(krl_code_2),
    Data8=flatten(lin_move_3))
R = ClusterOutput(merge_2)

# ==== cluster Cluster_7
drilling_safty_distance = Panel("7")
additional_drilling_depth = Panel("0.2")
percentage_on_line = Panel("0.7")
neg = Negative(Value=drilling_safty_distance)
depth_max = ClusterInput()
pt = ClusterInput()
pt_2 = ClusterInput()
pt_3 = ClusterInput()
num = ClusterInput()
pt_4 = ClusterInput()
pt_5 = Point(pt)
pt_6 = Point(pt_2)
pt_7 = Point(pt_3)
pt_8 = Point(pt_4)
num_2 = Number(num)
depth_max_2 = Number(depth_max)
X = UnitX(Factor=1)
bolt_length = Set(num_2)
bolt_length_2 = Get(bolt_length)
division = Division(A=bolt_length_2, B="2")
neg_2 = Negative(Value=division)
pt3 = Set(pt_8)
pt3_2 = Get(pt3)
pt2 = Set(pt_7)
pt2_2 = Get(pt2)
ln = Line(StartPoint=pt2_2, EndPoint=pt3_2)
pt1 = Set(pt_6)
pt1_2 = Get(pt1)
pt0 = Set(pt_5)
pt0_2 = Get(pt0)
pt0_3 = Get(pt0)
xy = XYPlane(Origin=pt0_2)
merge = Merge(Data1=pt0_3, Data2=pt1_2)
pt0_4 = Get(pt0)
pt1_3 = Get(pt1)
pt2_3 = Get(pt2)
rev = Reverse(Vector=X)
depth_max_3 = Set(depth_max_2)
depth_max_4 = Get(depth_max_3)

# ---- group: top middle point
avr = Average(Input=merge)

# ---- group: plane
pl_3pt = Plane3Pt(PointA=pt0_4, PointB=pt1_3, PointC=pt2_3)

# ----
point_cut_plane_top_middle = Set(avr)
point_cut_plane_top_middle_2 = Get(point_cut_plane_top_middle)
point_cut_plane_top_middle_3 = Get(point_cut_plane_top_middle)
cut_plane = Set(pl_3pt)
cut_plane_2 = Get(cut_plane)
cut_plane_3 = Get(cut_plane)
cut_plane_4 = Get(cut_plane)
cut_plane_5 = Get(cut_plane)
cut_plane_6 = Get(cut_plane)
cut_plane_7 = Get(cut_plane)

# ---- group: from top middle point toward right blow along plane
xprod = CrossProduct(VectorA=rev, VectorB=cut_plane_7, Unitize=False)  # -> Vector, Length

# ----
vec__x_cross_cut_plane = Set(xprod.Vector)
vec__x_cross_cut_plane_2 = Get(vec__x_cross_cut_plane)
line = LineSDL(Start=point_cut_plane_top_middle_2, Direction=vec__x_cross_cut_plane_2, Length=1)
llx = LineLine(Line1=line, Line2=ln)  # -> ParamA, ParamB, PointA, PointB
point_cut_plane_bottom = Set(llx.PointA)
point_cut_plane_bottom_2 = Get(point_cut_plane_bottom)
ln_2 = Line(StartPoint=point_cut_plane_top_middle_3, EndPoint=point_cut_plane_bottom_2)
cut_plane_line = Set(ln_2)
cut_plane_line_2 = Get(cut_plane_line)
eval = EvaluateCurve(Curve=cut_plane_line_2, Parameter=percentage_on_line)  # -> Point, Tangent, Angle
drilling_point_on_cut_plane = Set(eval.Point)
drilling_point_on_cut_plane_2 = Get(drilling_point_on_cut_plane)
drilling_point_on_cut_plane_3 = Get(drilling_point_on_cut_plane)
drilling_point_on_cut_plane_4 = Get(drilling_point_on_cut_plane)
pl = PlaneNormal(Origin=drilling_point_on_cut_plane_2, ZAxis=cut_plane_2)
line_2 = LineSDL(Start=pl, Direction=cut_plane_3, Length=1)
plx = LinePlane(Line=line_2, Plane=xy)  # -> Point, ParamL, ParamP
drilling_point_on_top_plane = Set(plx.Point)
drilling_point_on_top_plane_2 = Get(drilling_point_on_top_plane)
drilling_point_on_top_plane_3 = Get(drilling_point_on_top_plane)
drilling_point_on_top_plane_4 = Get(drilling_point_on_top_plane)
drilling_point_on_top_plane_5 = Get(drilling_point_on_top_plane)
subtraction = Subtraction(A=drilling_point_on_cut_plane_4, B=drilling_point_on_top_plane_5)
dist = Distance(PointA=drilling_point_on_cut_plane_4, PointB=drilling_point_on_top_plane_5)
drilling_distance_full = Set(dist)
drilling_distance_full_2 = Get(drilling_distance_full)
addition = Addition(A=drilling_distance_full_2, B=additional_drilling_depth)
drilling_distance_full_3 = Get(drilling_distance_full)
addition_2 = Addition(A=drilling_distance_full_3, B=additional_drilling_depth)
drilling_vector = Set(subtraction)
drilling_vector_2 = Get(drilling_vector)
drilling_vector_3 = Get(drilling_vector)
drilling_vector_4 = Get(drilling_vector)
amp = Amplitude(Vector=drilling_vector_2, Amplitude=neg)
amp_2 = Amplitude(Vector=drilling_vector_3, Amplitude=neg_2)
amp_3 = Amplitude(Vector=drilling_vector_4, Amplitude=addition)
move = Move(Geometry=drilling_point_on_top_plane_2, Motion=amp)  # -> Geometry, Transform
move_2 = Move(Geometry=drilling_point_on_cut_plane_3, Motion=amp_2)  # -> Geometry, Transform
move_3 = Move(Geometry=drilling_point_on_top_plane_3, Motion=amp_3)  # -> Geometry, Transform
pl_2 = PlaneNormal(Origin=move_3.Geometry, ZAxis=cut_plane_4)
pl_3 = PlaneNormal(Origin=move.Geometry, ZAxis=cut_plane_5)
pl_4 = PlaneNormal(Origin=move_2.Geometry, ZAxis=cut_plane_6)
cut_plane_full_depth_1 = Set(pl_2)
drilling_distance_full_1 = Set(addition_2)
start_plane = Set(pl_3)
cut_plane_middle = Set(pl_4)
cut_plane_middle_2 = Get(cut_plane_middle)
dist_2 = Distance(PointA=cut_plane_middle_2, PointB=drilling_point_on_top_plane_4)
smaller = SmallerThan(FirstNumber=dist_2, SecondNumber=depth_max_4)  # -> SmallerThan, OrEqualTo
smaller_than = ClusterOutput(smaller.SmallerThan)
cut_plane_full_depth_1_2 = Get(cut_plane_full_depth_1)
drilling_point_on_top_plane_6 = Get(drilling_point_on_top_plane)
cut_plane_middle_3 = Get(cut_plane_middle)
start_plane_2 = Get(start_plane)
start_plane_3 = Get(start_plane)
drilling_point_on_cut_plane_5 = Get(drilling_point_on_cut_plane)
merge_2 = Merge(Data1=start_plane_3, Data2=cut_plane_middle_3, Data3=start_plane_3)
merge_3 = Merge(Data1=start_plane_2, Data2=cut_plane_full_depth_1_2, Data3=start_plane_2)
cut_plane_full_depth_1_3 = Get(cut_plane_full_depth_1)
pt_9 = Point(drilling_point_on_top_plane_6)
R = ClusterOutput(merge_2)
pt_10 = ClusterOutput(pt_9)
R_2 = ClusterOutput(merge_3)
pt_11 = Point(drilling_point_on_cut_plane_5)
pt_12 = Point(cut_plane_full_depth_1_3)
ln_3 = Line(StartPoint=pt_11, EndPoint=pt_12)
drilling_point_on_top_plane_7 = Get(drilling_point_on_top_plane)
cut_plane_full_depth_1_4 = Get(cut_plane_full_depth_1)
should_be_half_bolt_length_1 = Panel(ln_3)
dist_3 = Distance(PointA=cut_plane_full_depth_1_4, PointB=drilling_point_on_top_plane_7)
actual_depth = Panel(dist_3)

# ==== cluster Cluster_8
lcomb1 = ClusterInput()
lcomb2 = ClusterInput()
lcomb3 = ClusterInput()
N = ClusterInput()
lcomb3_2 = Data(lcomb3)
lcomb1_2 = Data(lcomb1)
lcomb2_2 = Data(lcomb2)
N_2 = Data(N)
multiplication = Multiplication(A=lcomb2_2, B=N_2)
multiplication_2 = Multiplication(A=lcomb3_2, B=N_2)
multiplication_3 = Multiplication(A=lcomb1_2, B=N_2)
ma = MassAddition(Input=multiplication_2)  # -> Result, PartialResults
ma_2 = MassAddition(Input=multiplication)  # -> Result, PartialResults
ma_3 = MassAddition(Input=multiplication_3)  # -> Result, PartialResults
merge = Merge(Data1=ma_3.Result, Data2=ma_2.Result, Data3=ma.Result)
maxmin = MaxMin(Numbers=merge)  # -> Min, Max
maxmin_2 = MaxMin(Numbers=flatten(maxmin.Max))  # -> Min, Max
maxmin_3 = MaxMin(Numbers=flatten(maxmin.Min))  # -> Min, Max
lng = ListLength(List=flatten(maxmin.Max))
L = ClusterOutput(lng)
min = ClusterOutput(maxmin_3.Min)
max = ClusterOutput(maxmin_2.Max)

# ==== cluster Cluster_9
num = ClusterInput()
num_2 = ClusterInput()
pt = ClusterInput()
pt_2 = Point(pt)
num_3 = Number(num)
num_4 = Number(num_2)
division = Division(A=num_3, B=2)
division_2 = Division(A=num_3, B=2)
item = ListItem(List=pt_2, Index=0, Wrap=True)  # -> Item, Item1, Item2, Item3, Item4, Item5, Item6, Item7
Z = UnitZ(Factor=expr("-x", division))
Y = UnitY(Factor=expr("-x", num_4))
Z_2 = UnitZ(Factor=expr("-x", division_2))
Y_2 = UnitY(Factor=num_4)
merge = Merge(Data1=item.Item, Data2=item.Item1)
merge_2 = Merge(Data1=item.Item4, Data2=item.Item5)
avr = Average(Input=merge)
avr_2 = Average(Input=merge_2)
Y_3 = UnitY(Factor=expr("-x", num_4))
Y_4 = UnitY(Factor=num_4)
move = Move(Geometry=avr, Motion=Y_4)  # -> Geometry, Transform
move_2 = Move(Geometry=avr_2, Motion=Y_3)  # -> Geometry, Transform
move_3 = Move(Geometry=move.Geometry, Motion=Z)  # -> Geometry, Transform
move_4 = Move(Geometry=move_2.Geometry, Motion=Z_2)  # -> Geometry, Transform
ln = Line(StartPoint=move.Geometry, EndPoint=move_3.Geometry)
ln_2 = Line(StartPoint=move_2.Geometry, EndPoint=move_4.Geometry)
_5mm_offset = Panel("5")
_1mm_deeper = Panel("1")
ext = ExtendCurve(Curve=ln, Type=0, Start=_5mm_offset, End=_1mm_deeper)
ext_2 = ExtendCurve(Curve=ln_2, Type=0, Start=_5mm_offset, End=_1mm_deeper)
end = EndPoints(Curve=ext)  # -> Start, End
end_2 = EndPoints(Curve=ext_2)  # -> Start, End
merge_3 = Merge(Data1=end.Start, Data2=end.End, Data3=end.Start)
merge_4 = Merge(Data1=end_2.Start, Data2=end_2.End, Data3=end_2.Start)
xy = XYPlane(Origin=merge_3)
xy_2 = XYPlane(Origin=merge_4)
P = ClusterOutput(xy)
P_2 = ClusterOutput(xy_2)

# ==== cluster Cluster_10
G = ClusterInput()
offset = ClusterInput()
Z = UnitZ(Factor="-5")
offset_2 = Number(offset)
move = Move(Geometry=G, Motion=Z)  # -> Geometry, Transform
Z_2 = UnitZ(Factor=offset_2)
move_2 = Move(Geometry=move.Geometry, Motion=Z_2)  # -> Geometry, Transform
merge = Merge(Data1=move_2.Geometry, Data2=move.Geometry)
rev = ReverseList(List=merge)
orient_pln = OrientPlaneKUKAPrc(Plane=merge, OrientPoint="0,1000,0")
orient_pln_2 = OrientPlaneKUKAPrc(Plane=rev, OrientPoint="0,1000,0")
vel = ClusterInput()
vel_2 = ClusterInput()
lin_move = KUKAPrcLINearMovement(TargetAsPlane=orient_pln, Speed=vel, extaxenabled=False, interpolation="C_DIS")
lin_move_2 = KUKAPrcLINearMovement(TargetAsPlane=orient_pln_2, Speed=vel_2, extaxenabled=False, interpolation="C_DIS")
wait = WaitKUKAPrc(KUKAPrcWait="5")
merge_2 = Merge(Data1=flatten(lin_move), Data2=flatten(wait), Data3=flatten(lin_move_2))
R = ClusterOutput(merge_2)

# ==== cluster Cluster
pln = ClusterInput()
pln_2 = Plane(pln)
rotate = Rotate(Geometry=pln_2, Angle="-0.5*Pi", Plane=pln_2)  # -> Geometry, Transform
G = ClusterOutput(rotate.Geometry)

# ==== cluster Cluster_5
G = ClusterInput()
orient_pln = OrientPlaneKUKAPrc(Plane=G, OrientPoint="0,0,0")
rotate = Rotate(Geometry=G, Angle="0.25*Pi", Plane=G)  # -> Geometry, Transform
G_2 = ClusterOutput(rotate.Geometry)

# ==== cluster Cluster_6
G = ClusterInput()
rotate = Rotate(Geometry=G, Angle="0.25*Pi", Plane=G)  # -> Geometry, Transform
G_2 = ClusterOutput(rotate.Geometry)
